# Grasshopper definition License_activation.gh (Grasshopper 1.0.8)
# Copyright: Arup

# Switch the toggle 'True'
# to activate the license
activate = BooleanToggle(False)
cluster = Cluster(activate=activate)
status = Panel(cluster)

# ==== cluster Cluster
activate = ClusterInput()
c_script = CSharpScript(Activate=activate)  # -> License_ID, Password; inputs Activate: Boolean
# ---------- c_script: C# ----------
using System;
using System.Windows.Forms;

// Outputs
License_ID = "";
Password = "";

// Trigger using Activate
if (!(bool)Activate)
{
  return;
}

// Create form
Form prompt = new Form();
prompt.Width = 850;
prompt.Height = 420;
prompt.Text = "Activate Oasys AdSec API License";
prompt.StartPosition = FormStartPosition.CenterScreen;
prompt.FormBorderStyle = FormBorderStyle.FixedDialog;
prompt.MaximizeBox = false;
prompt.MinimizeBox = false;
prompt.TopMost = true;

// Title
Label titleLabel = new Label();
titleLabel.Left = 30;
titleLabel.Top = 20;
titleLabel.AutoSize = true;
titleLabel.Text = "Enter your License ID and Password";
titleLabel.Font = new System.Drawing.Font("Segoe UI", 14);

// License Label (NO colon ✅)
Label licenseLabel = new Label();
licenseLabel.Left = 30;
licenseLabel.Top = 100;
licenseLabel.AutoSize = true;
licenseLabel.Text = "License ID";
licenseLabel.Font = new System.Drawing.Font("Segoe UI", 11);

// License TextBox (fixed positioning so nothing hides)
TextBox licenseTextBox = new TextBox();
licenseTextBox.Left = 220;
licenseTextBox.Top = 95;
licenseTextBox.Width = 580;
licenseTextBox.Font = new System.Drawing.Font("Segoe UI", 11);

// Password Label (NO colon ✅)
Label passwordLabel = new Label();
passwordLabel.Left = 30;
passwordLabel.Top = 170;
passwordLabel.AutoSize = true;
passwordLabel.Text = "Password";
passwordLabel.Font = new System.Drawing.Font("Segoe UI", 11);

// Password TextBox
TextBox passwordTextBox = new TextBox();
passwordTextBox.Left = 220;
passwordTextBox.Top = 165;
passwordTextBox.Width = 580;
passwordTextBox.Font = new System.Drawing.Font("Segoe UI", 11);
passwordTextBox.UseSystemPasswordChar = true;

// Activate Button (NOT bold ✅)
Button okButton = new Button();
okButton.Text = "Activate";
okButton.Left = 520;
okButton.Top = 280;
okButton.Width = 140;
okButton.Height = 45;
okButton.Font = new System.Drawing.Font("Segoe UI", 10);
okButton.DialogResult = DialogResult.OK;

// Cancel Button
Button cancelButton = new Button();
cancelButton.Text = "Cancel";
cancelButton.Left = 680;
cancelButton.Top = 280;
cancelButton.Width = 140;
cancelButton.Height = 45;
cancelButton.Font = new System.Drawing.Font("Segoe UI", 10);
cancelButton.DialogResult = DialogResult.Cancel;

// Add controls
prompt.Controls.Add(titleLabel);
prompt.Controls.Add(licenseLabel);
prompt.Controls.Add(licenseTextBox);
prompt.Controls.Add(passwordLabel);
prompt.Controls.Add(passwordTextBox);
prompt.Controls.Add(okButton);
prompt.Controls.Add(cancelButton);



// Show dialog
DialogResult result = prompt.ShowDialog();

if (result == DialogResult.OK)
{
  License_ID = licenseTextBox.Text;
  Password = passwordTextBox.Text;
}
else
{
  License_ID = "";
  Password = "";
}

prompt.Dispose();
# ---------- end c_script ----------
python_3_script = Python3Script(License_ID=c_script.License_ID, Password=c_script.Password)  # -> Status
# ---------- python_3_script: Python ----------
from Oasys.AdSec import ILicense

Status = ""

x = str(License_ID).strip()
y = str(Password).strip()

# Detect cancel
if x == "" and y == "":
    Status = "Activation cancelled"
else:
    try:
        if x == "" or y == "":
            Status = "Activation failed"
        else:
            res = ILicense.ActivateLicense(x, y)

            if res.ActionStatus:
                lines = []
                lines.append("Activation successful")

                # Product details
                if res.ProductInformation:
                    lines.append("\n--- Product ---")
                    lines.append(res.ProductInformation.ProductName)
                    lines.append(res.ProductInformation.Version)

                # License details
                if res.LicenseInformation:
                    lines.append("\n--- License ---")
                    lines.append("Company: {}".format(res.LicenseInformation.CompanyName))
                    lines.append("License ID: {}".format(res.LicenseInformation.LicenseId))
                    lines.append("Seats: {}".format(res.LicenseInformation.NumberOfSeats))
                    lines.append("Days Left: {}".format(res.LicenseInformation.NumberOfDays))

                Status = "\n".join(lines)

            else:
                Status = "Activation failed"

    except:
        Status = "Activation failed"
# ---------- end python_3_script ----------
status = ClusterOutput(python_3_script)
