# Grasshopper definition License_deactivation.gh (Grasshopper 1.0.8)
# Copyright: Arup

# ----
# Switch the toggle 'True' to deactivate the license
deactivate = BooleanToggle(False)

python_3_script = Python3Script(Deactivate=deactivate)  # -> Status
# ---------- python_3_script: Python ----------
from Oasys.AdSec import ILicense

if Deactivate == True:

    action = ILicense.DeactivateLicense()
    if action.ActionStatus == 1:
        Status = f"{action.ProductInformation.ProductName} v{action.ProductInformation.Version} license deactivated successfully!"
        print(Status)

    else:
        for warning in action.Warnings:
            Status = warning.Description
            print(Status)

else:

    Status = "Set the 'Deactivate' toggle to True to deactivate the license."
    print(Status)
# ---------- end python_3_script ----------
panel = Panel(python_3_script)
