# Grasshopper definition Rectangular section.gh (Grasshopper 1.0.7)
# plug-ins: AdSec

# ----
# Material & Profile
material = StandardMaterial(Material_Type="Concrete", Design_Code=["EN1992", "NoNationalAnnex"], Grade="C32_40")
profile = CreateProfile(
    Depth_mm=Slider(600, range=200..1000),
    Width_mm=Slider(300, range=200..1000),
    LocalPlane=PlaneYZ(0, 0, 0),
    catalogueIndex=-1,
    inclSS=False,
    lengthUnit="Millimeter",
    mode="Other",
    Profile_type="Rectangle",
    Measure="Millimeter",
    typeIndex=-1)

# ----
# Reinforcement
material_2 = StandardMaterial(Material_Type="Rebar", Design_Code=["EN1992", "NoNationalAnnex"], Grade="S500B")
rebar = CreateRebar(Material=material_2, Diameter_mm=Slider(10, range=10..25), Rebar_Type="Single", Measure="Millimeter")
rebar_2 = CreateRebar(Material=material_2, Diameter_mm=Slider(16, range=10..25), Rebar_Type="Single", Measure="Millimeter")
rebar_3 = CreateRebar(Material=material_2, Diameter_mm=Slider(16, range=10..25), Rebar_Type="Single", Measure="Millimeter")
rebar_4 = CreateRebar(Material=material_2, Diameter_mm=Slider(16, range=10..25), Rebar_Type="Single", Measure="Millimeter")
rebar_5 = CreateRebar(Material=material_2, Diameter_mm=Slider(20, range=10..25), Rebar_Type="Single", Measure="Millimeter")
number_slider = Slider(0.03, range=0.005..0.05)
spacing = CreateRebarSpacing(Rebar=rebar_2, Spacing_mm=Slider(150, range=150..200), Spacing_method="Distance", Measure="mm")
spacing_2 = CreateRebarSpacing(Rebar=rebar_3, Count=Slider(3, range=1..10), Spacing_method="Count")
spacing_3 = CreateRebarSpacing(Rebar=rebar_4, Count=Slider(3, range=1..10), Spacing_method="Count")
spacing_4 = CreateRebarSpacing(Rebar=rebar_5, Count=Slider(5, range=1..10), Spacing_method="Count")
reinforcement_group = CreateReinforcementGroup(Rebar=rebar, Cover=number_slider, LengthUnit="Millimeter", Mode="Link", Group_Type="Link", Measure="mm")
reinforcement_group_2 = CreateReinforcementGroup(
    TopRebars=spacing,
    LeftSideRebars=spacing_2,
    RightSideRebars=spacing_3,
    BottomRebars=spacing_4,
    Cover=number_slider,
    LengthUnit="Meter",
    Mode="Template",
    Group_Type="Template",
    Measure="Meter")

# ----
# Section
section = CreateSection(Profile=profile, Material=material, RebarGroup=flatten([reinforcement_group_2, reinforcement_group]))

# ----
# Load
number_slider_2 = Slider(48, range=-10..50)
load = CreateLoad(
    Fx_kN=Slider(-78, range=-100..11),
    Myy_kN_m=Slider(-9, range=-10..10),
    Mzz_kN_m=number_slider_2,
    Force_Unit="Kilonewton",
    Moment_Unit="KilonewtonMillimeter")

analyse = AnalyseSection(Section=section)  # -> Results, FailureSurface

# ----
# ULS / SLS Results
sls = ServiceabilityResult(Results=analyse.Results, Load=load)  # -> Load, flatten(Cracks), MaximumCrack, CrackUtil, Deformation, SecantStiffness, UncrackedMomentRanges
strength_result = StrengthResult(Results=analyse.Results, Load=load)  # -> Load, LoadUtil, Deformation, DeformationUtil, MomentRanges, NeutralAxis, NeutralAxisOffset, NeutralAxisAngle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
degrees = Degrees(Radians=[strength_result.NeutralAxisAngle, strength_result.FailureNeutralAxisAngle])
panel = Panel([sls.Load, sls.Cracks, sls.MaximumCrack, sls.CrackUtil, sls.UncrackedMomentRanges, sls.SecantStiffness, sls.Deformation])
panel_2 = Panel([strength_result.NeutralAxisOffset, strength_result.FailureDeformation, strength_result.FailureNeutralAxis, strength_result.FailureNeutralAxisOffset])
panel_3 = Panel([strength_result.Load, strength_result.LoadUtil, strength_result.Deformation, strength_result.DeformationUtil, strength_result.MomentRanges, strength_result.NeutralAxis])
panel_4 = Panel(degrees)

save = SaveAdSec(
    Section=section,
    Loads=load,
    Save=False,
    FileAndPath="C:\Temp\Rectangular section.ads",
    File="C:\Temp\Rectangular section.ads")

# ----
# Results
number_slider_3 = Slider(17, range=1..100)

# ----
# NM / MM Charts
# Use slider to adjust the chart size in Rhino
number_slider_4 = Slider(17, range=1..100)
rectangle = Rectangle(Plane=PlaneXY(0, 0, 0), XSize=number_slider_3, YSize=number_slider_4, Radius=0)  # -> Rectangle, Length
n_m_diagram = NMDiagram(Results=analyse.Results, Plot=rectangle.Rectangle, Interaction="N-M", Measure="°")

# ----
# Rebar Stress/Strain
rebar_stress_strain = RebarStressStrain(Results=analyse.Results, Load=load)  # -> graft(Position_mm), graft(ULS_ε), graft(ULS_MPa), graft(SLS_ε), graft(SLS_MPa)
panel_5 = Panel([rebar_stress_strain.Position_mm, rebar_stress_strain.ULS_ε, rebar_stress_strain.ULS_MPa, rebar_stress_strain.SLS_ε, rebar_stress_strain.SLS_MPa])

# ----
# Concrete Stress/Strain
panel_6 = Panel("""-0.150
-0.150
0.150
0.150""")
panel_7 = Panel("""0.300
-0.300
-0.300
0.300""")
create_vertex_point = CreateVertexPoint(Y_m=graft(panel_6), Z_m=graft(panel_7), Measure="m")
concrete_stress_strain = ConcreteStressStrain(Results=analyse.Results, Load=load, VertexPoint=create_vertex_point)  # -> ULSStrain_ε, ULSStress_MPa, SLSStrain_ε, SLSStress_MPa
panel_8 = Panel([concrete_stress_strain.ULSStrain_ε, concrete_stress_strain.ULSStress_MPa, concrete_stress_strain.SLSStrain_ε, concrete_stress_strain.SLSStress_MPa])
