# Grasshopper definition Rectangular section.gh (Grasshopper 1.0.7)
# plug-ins: AdSec

# ----
# Material & Profile
standard_material = StandardMaterial(Material_Type="Concrete", Design_Code=["EN1992", "NoNationalAnnex"], Grade="C32_40")
create_profile = CreateProfile(
    Depth_mm=Slider(600, range=200..1000),
    Width_mm=Slider(300, range=200..1000),
    LocalPlane=PlaneYZ(0, 0, 0),
    catalogueIndex=-1,
    inclSS=False,
    lengthUnit="Millimeter",
    mode="Other",
    Profile_type="Rectangle",
    Measure="Millimeter",
    typeIndex=-1)

# ----
# Reinforcement
standard_material_2 = StandardMaterial(Material_Type="Rebar", Design_Code=["EN1992", "NoNationalAnnex"], Grade="S500B")
create_rebar = CreateRebar(Material=standard_material_2, Diameter_mm=Slider(10, range=10..25), Rebar_Type="Single", Measure="Millimeter")
create_rebar_2 = CreateRebar(Material=standard_material_2, Diameter_mm=Slider(16, range=10..25), Rebar_Type="Single", Measure="Millimeter")
create_rebar_3 = CreateRebar(Material=standard_material_2, Diameter_mm=Slider(16, range=10..25), Rebar_Type="Single", Measure="Millimeter")
create_rebar_4 = CreateRebar(Material=standard_material_2, Diameter_mm=Slider(16, range=10..25), Rebar_Type="Single", Measure="Millimeter")
create_rebar_5 = CreateRebar(Material=standard_material_2, Diameter_mm=Slider(20, range=10..25), Rebar_Type="Single", Measure="Millimeter")
number_slider = Slider(0.03, range=0.005..0.05)
create_rebar_spacing = CreateRebarSpacing(Rebar=create_rebar_2, Spacing_mm=Slider(150, range=150..200), Spacing_method="Distance", Measure="mm")
create_rebar_spacing_2 = CreateRebarSpacing(Rebar=create_rebar_3, Count=Slider(3, range=1..10), Spacing_method="Count")
create_rebar_spacing_3 = CreateRebarSpacing(Rebar=create_rebar_4, Count=Slider(3, range=1..10), Spacing_method="Count")
create_rebar_spacing_4 = CreateRebarSpacing(Rebar=create_rebar_5, Count=Slider(5, range=1..10), Spacing_method="Count")
create_reinforcement_group = CreateReinforcementGroup(Rebar=create_rebar, Cover=number_slider, LengthUnit="Millimeter", Mode="Link", Group_Type="Link", Measure="mm")
create_reinforcement_group_2 = CreateReinforcementGroup(
    TopRebars=create_rebar_spacing,
    LeftSideRebars=create_rebar_spacing_2,
    RightSideRebars=create_rebar_spacing_3,
    BottomRebars=create_rebar_spacing_4,
    Cover=number_slider,
    LengthUnit="Meter",
    Mode="Template",
    Group_Type="Template",
    Measure="Meter")

# ----
# Section
create_section = CreateSection(
    Profile=create_profile,
    Material=standard_material,
    RebarGroup=flatten([create_reinforcement_group_2, create_reinforcement_group]))

# ----
# Load
number_slider_2 = Slider(48, range=-10..50)
create_load = CreateLoad(
    Fx_kN=Slider(-78, range=-100..11),
    Myy_kN_m=Slider(-9, range=-10..10),
    Mzz_kN_m=number_slider_2,
    Force_Unit="Kilonewton",
    Moment_Unit="KilonewtonMillimeter")

analyse_section = AnalyseSection(Section=create_section)  # -> Results, FailureSurface

# ----
# Results
# NM / MM Charts
# Use slider to adjust the chart size in Rhino
number_slider_3 = Slider(160, range=0..500)
vector_xyz = VectorXYZ(XComponent=number_slider_3, YComponent=Slider(160, range=0..500), ZComponent=0)  # -> Vector, Length
number_slider_4 = Slider(550, range=0..800)
xy_plane = XYPlane(Origin=vector_xyz.Vector)
rectangle = Rectangle(Plane=xy_plane, XSize=number_slider_4, YSize=number_slider_4, Radius=0)  # -> Rectangle, Length
n_m_diagram = NMDiagram(Results=analyse_section.Results, Plot=rectangle.Rectangle, Interaction="N-M", Measure="°")

# ----
# ULS / SLS Results
serviceability_result = ServiceabilityResult(Results=analyse_section.Results, Load=create_load)  # -> Load, flatten(Cracks), MaximumCrack, CrackUtil, Deformation, SecantStiffness, UncrackedMomentRanges
strength_result = StrengthResult(Results=analyse_section.Results, Load=create_load)  # -> Load, LoadUtil, Deformation, DeformationUtil, MomentRanges, NeutralAxis, NeutralAxisOffset, NeutralAxisAngle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
degrees = Degrees(Radians=[strength_result.NeutralAxisAngle, strength_result.FailureNeutralAxisAngle])
panel = Panel([serviceability_result.Load, serviceability_result.Cracks, serviceability_result.MaximumCrack, serviceability_result.CrackUtil, serviceability_result.UncrackedMomentRanges, serviceability_result.SecantStiffness, serviceability_result.Deformation])
panel_2 = Panel([strength_result.NeutralAxisOffset, strength_result.FailureDeformation, strength_result.FailureNeutralAxis, strength_result.FailureNeutralAxisOffset])
panel_3 = Panel([strength_result.Load, strength_result.LoadUtil, strength_result.Deformation, strength_result.DeformationUtil, strength_result.MomentRanges, strength_result.NeutralAxis])
panel_4 = Panel(degrees)

save_adsec = SaveAdSec(
    Section=create_section,
    Loads=create_load,
    Save=False,
    FileAndPath="C:\Temp\Rectangular section.ads",
    File="C:\Temp\Rectangular section.ads")

# ----
# Concrete Stress/Strain
panel_5 = Panel("""-0.150
-0.150
0.150
0.150""")
panel_6 = Panel("""0.300
-0.300
-0.300
0.300""")
create_vertex_point = CreateVertexPoint(Y_m=graft(panel_5), Z_m=graft(panel_6), Measure="m")
concrete_stress_strain = ConcreteStressStrain(Results=analyse_section.Results, Load=create_load, VertexPoint=create_vertex_point)  # -> ULSStrain_ε, ULSStress_MPa, SLSStrain_ε, SLSStress_MPa
panel_7 = Panel([concrete_stress_strain.ULSStrain_ε, concrete_stress_strain.ULSStress_MPa, concrete_stress_strain.SLSStrain_ε, concrete_stress_strain.SLSStress_MPa])

# ----
# Rebar Stress/Strain
rebar_stress_strain = RebarStressStrain(Results=analyse_section.Results, Load=create_load)  # -> graft(Position_mm), graft(ULSStrain), graft(ULSStress), graft(SLSStrain), graft(SLSStress)
panel_8 = Panel([rebar_stress_strain.Position_mm, rebar_stress_strain.ULSStrain, rebar_stress_strain.ULSStress, rebar_stress_strain.SLSStrain, rebar_stress_strain.SLSStress])
