# Grasshopper definition 3D Boxes.gh (Grasshopper 1.0.7)
# Copyright: Arup
# plug-ins: GSA

# ----
# Inputs
element_mesh_size = Slider(3, range=1..10)
move_factor_for_members = Slider(0.5, range=0.1..1.1)
size_of_members = Slider(15, range=0..100)

pt = ConstructPoint(XCoordinate=0, YCoordinate=0, ZCoordinate=0)
pt_2 = ConstructPoint(XCoordinate=size_of_members, YCoordinate=size_of_members, ZCoordinate=size_of_members)
multiplication = Multiplication(A=size_of_members, B=move_factor_for_members)
vec = VectorXYZ(XComponent=multiplication, YComponent=multiplication, ZComponent=multiplication)  # -> Vector, Length
box = Box2Pt(PointA=pt, PointB=pt_2, Plane=PlaneXY(0, 0, 0))
material = CreateCustomMaterial(
    ElasticModulus_MPa="18000",
    PoissonsRatio="0.3",
    Density_kg_m³="1200",
    Material_Type="Timber",
    Stress_Unit="MPa",
    Density_Unit="kg/m³",
    Temperature_Unit="K")
move = Move(Geometry=box, Motion=vec.Vector)  # -> Geometry, Transform
sunion = SolidUnion(Breps=[box, move.Geometry])
prop3d = Create3DProperty(Material=material)
mem3d = Create3DMember(Solid=sunion, Prop3D=prop3d, MeshSizeInModelUnits=element_mesh_size)
elemfrommem = ElementsFromMembers(_3DMembers_mm=mem3d, Tolerance=0.05, Unit="m")  # -> Nodes, _1DElements, _2DElements, _3DElements, GSAModel
no = Node(elemfrommem.Nodes)
pdecon = Deconstruct(Point=no)  # -> XComponent, YComponent, ZComponent
equals = Equality(FirstNumber=pdecon.ZComponent, SecondNumber="0")  # -> Equality, Inequality
cull = CullPattern(List=no, CullPattern=equals.Equality)
Y = UnitY(Factor=Slider(7, range=0..100))
gravityload = CreateGravityLoad(LoadCase=null, GravityFactor=Y)
createcombination = CreateCombinationCase(ID=0, Name="Combination 1", Description="2A1")
support = CreateSupport(Point=cull, Plane=PlaneXY(0, 0, 0), x=True, xx=True, y=True, yy=True, z=True, zz=True)
analyse = AnalyseModel(
    GSAGeometryIn_m=[mem3d, support],
    Load=gravityload,
    AnalysisTasksCombinations=createcombination,
    Analyse=True,
    ReMesh=True,
    Tolerance=0.05,
    Unit="m")  # -> Model, Errors, Warnings, Remarks, Log

save = SaveGSAModel(GSAModel=analyse.Model, Save=True, FileAndPath="C:\temp\3D Box.gwb")

selres = SelectResults(GSAModel=analyse.Model, Type="AnalysisCase", Case_ID="A1")
contourelem3d = _3DContourResults(
    Result=selres,
    ElementFilterList="All",
    Display=3,
    Mode=0,
    envelope="Absolute",
    legend=True,
    legendScale=1,
    length="mm",
    noDec=0,
    Result_Type="Displacement",
    Component="Resolved |U|",
    slider=True,
    stress="MPa",
    val=310,
    valMax=1000,
    valMin=0)  # -> NgonMesh, Colours, Values_mm
