# Grasshopper definition Edit & update existing models.gh (Grasshopper 1.0.7)
# plug-ins: GSA

# ----
# Download the 'Framed Structure' GSA model file and add its location in
# the below panel to open it or use Open option in the 'Open' component.
panel = Panel("C:\Temp\Framed structure.gwb")
open = OpenModel(FilenameAndPath=panel)

# ----
# Inputs
# C:\Users\AbishekFestus.Winsto\OneDrive - Arup\Grasshopper demo files\Grasshopper scripts_modified\4. Periodic load analysis.gwb
distance_to_move = Slider(-0.5, range=-2..2)

getgeo = GetModelGeometry(GSAModel=open, Mode=1, Unit="m")  # -> NodesIn_m, _1DElementsIn_m, _2DElementsIn_m, _3DElementsIn_m, _1DMembersIn_m, _2DMembersIn_m, _3DMembersIn_m, Assemblies
brep = Brep(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)
brep_2 = Brep(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)
brepsinc = PointInBreps(Brep=[brep, brep_2], Point=getgeo.NodesIn_m, Strict=False)  # -> Inside, Index
cull = CullPattern(List=getgeo.NodesIn_m, CullPattern=brepsinc.Inside)
dispatch = Dispatch(List=cull, DispatchPattern=[True, True, True, True, True, False, False, False, False, False])  # -> ListA, ListB
entwine = Entwine(Branch00=dispatch.ListA, Branch01=dispatch.ListB, FlattenInputs=True)  # -> simplify(Result)
cull_2 = CullPattern(List=entwine, CullPattern=[True, False])
Y = UnitY(Factor=distance_to_move)
neg = Negative(Value=Y)
pt = Point(cull_2)
no = Node(cull_2)
entwine_2 = Entwine(Branch00=Y, Branch01=neg, FlattenInputs=True)  # -> simplify(Result)
nodeedit = EditNode(Node=no, Mode=1)  # -> Node, NodeNumber, NodePosition, NodeLocalAxis, NodeRestraints, DamperProperty, MassProperty, SpringProperty, NodeName, NodeColour
move = Move(Geometry=pt, Motion=entwine_2)  # -> Geometry, Transform
nodeedit_2 = EditNode(Node=nodeedit.Node, NodeNumber=nodeedit.NodeNumber, NodePosition=move.Geometry, Mode=1)  # -> Node, NodeNumber, NodePosition, NodeLocalAxis, NodeRestraints, DamperProperty, MassProperty, SpringProperty, NodeName, NodeColour
analyse = AnalyseModel(ModelS=open, GSAGeometryIn_m=flatten(nodeedit_2.Node), Analyse=True, ReMesh=True, Tolerance=0.01, Geometry_Unit="Meter")  # -> Model, Errors, Warnings, Remarks, Log
getgeo_2 = GetModelGeometry(GSAModel=analyse.Model, Mode=1, Unit="m")  # -> NodesIn_m, _1DElementsIn_m, _2DElementsIn_m, _3DElementsIn_m, _1DMembersIn_m, _2DMembersIn_m, _3DMembersIn_m, Assemblies

save = SaveGSAModel(GSAModel=analyse.Model, Save=True, FileAndPath="C:\Temp\Updated model.gwb")
