# Grasshopper definition Footfall.gh (Grasshopper 1.0.7)
# plug-ins: GSA

# ----
# Inputs [m]
no_of_bays_x = Slider(4, range=0..10)
no_of_bays_y = Slider(6, range=0..10)
bay_width_x = Slider(5, range=0..10)
bay_width_y = Slider(3, range=0..10)
bay_height = Slider(3, range=0..10)
slab_thickness = Slider(0.1, range=0.05..1)
beam_section_depth = Slider(0.25, range=0.05..1)
beam_section_width = Slider(0.25, range=0.05..1)
column_section_depth = Slider(0.25, range=0.05..1)
column_section_width = Slider(0.25, range=0.05..1)

# ----
# Open 'Modal analysis (Seed file)'
panel = Panel("C:\Temp\Modal analysis (Seed file).gwb")
open = OpenModel(FilenameAndPath=panel)

vec = VectorXYZ(XComponent=0, YComponent=0, ZComponent=0)  # -> Vector, Length
multiplication = Multiplication(A=bay_width_x, B=no_of_bays_x)
multiplication_2 = Multiplication(A=bay_width_y, B=no_of_bays_y)
recgrid = Rectangular(Plane=PlaneXY(0, 0, 0), SizeX=bay_width_x, SizeY=bay_width_y, ExtentX=no_of_bays_x, ExtentY=no_of_bays_y)  # -> flatten(Cells), flatten(Points)
series = Series(Start=vec.Vector, Step=bay_width_y, Count=expr("x+1", no_of_bays_y))
series_2 = Series(Start=vec.Vector, Step=bay_width_x, Count=expr("x+1", no_of_bays_x))
vec_2 = VectorXYZ(XComponent=multiplication, YComponent=0, ZComponent=0)  # -> Vector, Length
vec_3 = VectorXYZ(XComponent=0, YComponent=multiplication_2, ZComponent=0)  # -> Vector, Length
vec_4 = VectorXYZ(XComponent=multiplication, YComponent=multiplication_2, ZComponent=0)  # -> Vector, Length
Z = UnitZ(Factor=bay_height)
vec_5 = VectorXYZ(XComponent=0, YComponent=series, ZComponent=0)  # -> Vector, Length
vec_6 = VectorXYZ(XComponent=series_2, YComponent=0, ZComponent=0)  # -> Vector, Length
ln = Line(StartPoint=vec.Vector, EndPoint=vec_2.Vector)
ln_2 = Line(StartPoint=vec.Vector, EndPoint=vec_3.Vector)
move = Move(Geometry=recgrid.Points, Motion=Z)  # -> Geometry, Transform
srf4pt = _4PointSurface(CornerA=vec.Vector, CornerB=vec_2.Vector, CornerC=vec_4.Vector, CornerD=vec_3.Vector)
move_2 = Move(Geometry=ln, Motion=vec_5.Vector)  # -> Geometry, Transform
move_3 = Move(Geometry=ln_2, Motion=vec_6.Vector)  # -> Geometry, Transform
neg = Negative(Value=Z)
line = LineSDL(Start=move.Geometry, Direction=neg, Length=expr("x*2", bay_height))
crv = Curve(srf4pt)
mat = CreateMaterial(Material_type="Concrete", Design_Code="EC2-2", Grade="C40/50")
prop2d = Create2DProperty(Thickness_m=slab_thickness, Material=mat, Type="Shell", Unit="m")
profile = CreateProfile(
    Depth_m=beam_section_depth,
    Width_m=beam_section_width,
    catalogueIndex=-1,
    inclSS=False,
    lengthUnit="Meter",
    mode="Other",
    Profile_type="Rectangle",
    Measure="m",
    typeIndex=-1)
profile_2 = CreateProfile(
    Depth_m=column_section_depth,
    Width_m=column_section_width,
    catalogueIndex=-1,
    inclSS=False,
    lengthUnit="Meter",
    mode="Other",
    Profile_type="Rectangle",
    Measure="m",
    typeIndex=-1)
section = CreateSection(Profile=profile, Material=mat, Basic_Offset="Centroid")
section_2 = CreateSection(Profile=profile_2, Material=mat, Basic_Offset="Centroid")
mem2d = Create2DMember(
    Brep=crv,
    Property2D=prop2d,
    MeshSizeInModelUnits=Slider(0.2, range=0.1..1.1),
    InternalOffset=True,
    Preview3dSection=False,
    Mesh_mode="Quad dominant")
mem1d = Create1DMember(
    Curve=[move_2.Geometry, move_3.Geometry],
    Property=section,
    Preview3dSection=False,
    x1=False,
    x2=False,
    xx1=False,
    xx2=False,
    y1=False,
    y2=False,
    yy1=False,
    yy2=False,
    z1=False,
    z2=False,
    zz1=False,
    zz2=False)
mem1d_2 = Create1DMember(
    Curve=line,
    Property=section_2,
    Preview3dSection=False,
    x1=False,
    x2=False,
    xx1=False,
    xx2=False,
    y1=False,
    y2=False,
    yy1=False,
    yy2=False,
    z1=False,
    z2=False,
    zz1=False,
    zz2=False)
elemfrommem = ElementsFromMembers(_2DMembers_mm=mem2d, Tolerance=0.001, Unit="Meter")  # -> Nodes, _1DElements, _2DElements, _3DElements, GSAModel
mesh = Mesh(elemfrommem._2DElements)
demesh = DeconstructMesh(Mesh=mesh)  # -> Vertices, Faces, Colours, Normals
incurve = PointInCurve(Point=demesh.Vertices, Curve=crv)  # -> Relationship, Point
equals = Equality(FirstNumber=incurve.Relationship, SecondNumber=1)  # -> Equality, Inequality
cull = CullPattern(List=demesh.Vertices, CullPattern=equals.Equality)
end = EndPoints(Curve=mem1d_2)  # -> Start, End
support = CreateSupport(Point=[end.Start, end.End], Plane=PlaneXY(0, 0, 0), x=True, xx=True, y=True, yy=True, z=True, zz=True)
support_2 = CreateSupport(Point=cull, Plane=PlaneXY(0, 0, 0), x=True, xx=False, y=True, yy=False, z=True, zz=False)
mem2dedit = Edit2DMember(Member2D=mem2d, InclPoints=support_2, Preview3dSection=False)  # -> Member2D, MemberNumber, Brep, InclPoints, InclCurves, _2DProperty, MemberGroup, MemberType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
σt = CreateAnalysisTask(
    TaskID="2",
    Name="Footfall",
    ModalAnalysisTask="1",
    ResponseNodes="All",
    ExcitationNodes="All",
    NumberOfFootfalls="100",
    Walker="0.076",
    DirectionOfResponses="1",
    FrequencyWeightingCurve="3",
    ExcitationForcesDLFs="3",
    ConstantDamping="0.0199",
    casesParamIndex=9,
    Solver="Footfall",
    Method="Rigorous excitation")
gravityload = CreateGravityLoad(LoadCase=null, GravityFactor=Vector(0, 0, -1))
analyse = AnalyseModel(
    ModelS=open,
    GSAGeometryIn_m=flatten([mem1d, mem1d_2, support, support_2, mem2dedit.Member2D]),
    Loads=gravityload,
    AnalysisTasksCombinations=flatten(σt),
    Analyse=True,
    ReMesh=True,
    Tolerance=0.001,
    Geometry_Unit="Meter")  # -> Model, Errors, Warnings, Remarks, Log

save = SaveGSAModel(GSAModel=analyse.Model, Save=True, FileAndPath="C:\Temp\Footfall.gwb")

# ----
# A1 to A100 -- Mode shapes
# A101 -- Footfall
selres = SelectResults(GSAModel=analyse.Model, Type="AnalysisCase", Case_ID="A101")

# ----
# Modal dynamic results (A1 to A100)
globalperformance = GlobalPerformanceResults(Result=selres, Mass_Unit="t", Inertia_Unit="m⁴", Stiffness_Unit="kN/m")  # -> EffectiveMassX_t, EffectiveMassY_t, EffectiveMassZ_t, EffectiveInertiaX_m⁴, EffectiveInertiaY_m⁴, EffectiveInertiaZ_m⁴, Mode, ModalMass_t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
modal_frequency = Panel(globalperformance.Frequency_Hz)

contourelem1d = _1DContourResults(
    Result=selres,
    ElementFilterList="All",
    IntermediatePoints=10,
    Scale=10,
    Display=1,
    Mode=3,
    energy="MJ",
    envelope="Absolute",
    force="kN",
    legend=False,
    legendHeight=110,
    legendScale=1,
    legendWidth=120,
    length="mm",
    moment="kN·m",
    noDec=0,
    Result_Type="Footfall",
    Component="Transient",
    slider=False,
    stress="MPa",
    val=0,
    valMax=1000,
    valMin=0)  # -> L, Colours, LegendValues_
contourelem2d = _2DContourResults(
    Result=selres,
    ElementFilterList="All",
    Display=0,
    Mode=3,
    envelope="Absolute",
    flayer=0,
    force="kN/m",
    legend=True,
    legendHeight=110,
    legendScale=1,
    legendWidth=120,
    length="mm",
    model="m",
    moment="kN",
    noDec=0,
    Result_Type="Footfall",
    Component="Resonant",
    slider=False,
    stress="MPa",
    val=0,
    valMax=1000,
    valMin=0)  # -> M, Colours, LegendValues_
footfall = FootfallResults(Result=selres, Type="Resonant", Max_Min="Max Response Factor")  # -> MaximumResponseFactor, PeakVelocity_m_s, RMSVelocity_m_s, PeakAcceleration_m_s, RMSAcceleration_m_s, CriticalNode, CriticalFrequency_Hz, NodesIDs
footfall_2 = FootfallResults(Result=selres, Type="Transient", Max_Min="Max Response Factor")  # -> MaximumResponseFactor, PeakVelocity_m_s, RMSVelocity_m_s, PeakAcceleration_m_s, RMSAcceleration_m_s, CriticalNode, CriticalFrequency_Hz, NodesIDs
max_transient_response_factor = Panel([footfall_2.MaximumResponseFactor, footfall_2.PeakVelocity_m_s, footfall_2.RMSVelocity_m_s, footfall_2.PeakAcceleration_m_s, footfall_2.RMSAcceleration_m_s, footfall_2.CriticalNode, footfall_2.CriticalFrequency_Hz, footfall_2.NodesIDs])
max_resonant_response_factor = Panel([footfall.MaximumResponseFactor, footfall.PeakVelocity_m_s, footfall.RMSVelocity_m_s, footfall.PeakAcceleration_m_s, footfall.RMSAcceleration_m_s, footfall.CriticalNode, footfall.CriticalFrequency_Hz, footfall.NodesIDs])
