# Grasshopper definition GSA to ETABS using GG.gh (Grasshopper 1.0.8)
# Copyright: Arup
# plug-ins: BullAnt, ggRhinoGSA, ggRhinoETABS, GSA

gggrasshoppersettings = GgGrasshopperSettings(SettingsData_DocumentUnits="Millimeters", SettingsData_NewFile=True, SettingsData_PlaceInClipboard=False)
gggrasshoppersettings_2 = GgGrasshopperSettings(SettingsData_NewFile=True, SettingsData_PlaceInClipboard=False, SettingsData_Version="v10_2")

# ----
# GSA file to export
# Download the 'GSA to ETABS' model file from the
# sample files website (https://samples.oasys-software
# .com/gsa/10.2/Gsa_GH/) and add its path below
panel = Panel("C:\Temp\GSA to ETABS.gwb")
open_model = OpenModel(FilenameAndPath=panel)
get_model_geometry = GetModelGeometry(GSAModel=open_model, Mode=1, Unit="mm")  # -> NodesIn_mm, _1DElementsIn_mm, _2DElementsIn_mm, _3DElementsIn_mm, _1DMembersIn_mm, _2DMembersIn_mm, _3DMembersIn_mm, Assemblies

# ----
# ETABS
# Enter the file path and set the toggle
# to True to import and save the file
# Set the toggle to True to run analysis
panel_2 = Panel("C:\Temp\GSA to ETABS.edb")
ggetabsbakemodel = GgETABSBakeModel(
    Enabled=Toggle(False),
    Units=5,
    SavePath=panel_2,
    NewModel=True,
    TagForUpdate=False,
    SaveFile=False,
    Attach=False,
    License=0)  # -> Succeeded, Model, Error
panel_3 = Panel(ggetabsbakemodel.Succeeded)
panel_4 = Panel(ggetabsbakemodel.Model)
panel_5 = Panel(ggetabsbakemodel.Error)
ggetabssolver = GgETABSSolver(Active=Toggle(True), Model=ggetabsbakemodel.Model, GlobalPointRestraint="FFFFFF")  # -> Model, Results, Log

# ----
# Supports
get_model_lists = GetModelLists(GSAModel=open_model)
list_info = ListInfo(List=get_model_lists, Unit="mm")  # -> Index, Name, Type, Definition, ListObjectsIn_mm, ExpandList
edit_node = EditNode(Node=list_info.ListObjectsIn_mm, Mode=1)  # -> Node, NodeNumber, NodePosition, NodeLocalAxis, NodeRestraints, DamperProperty, MassProperty, SpringProperty, NodeName, NodeColour
edit_bool6 = EditBool6(Bool6=edit_node.NodeRestraints)  # -> Bool6, X, Y, Z, XX, YY, ZZ
ggetabspointrestraint = GgETABSPointRestraint(
    RestraintX=edit_bool6.X,
    RestraintY=edit_bool6.Y,
    RestraintZ=edit_bool6.Z,
    RestraintXX=edit_bool6.XX,
    RestraintYY=edit_bool6.YY,
    RestraintZZ=edit_bool6.ZZ)
ggetabspointatts = GgETABSPointAtts(
    LocalAxis=Plane(origin=(-1.234321012e+308, -1.234321012e+308, -1.234321012e+308), x=(0, 0, 0), y=(0, 0, 0)),
    Restraint=ggetabspointrestraint,
    LowNodeID=1,
    MergeNumber=0)
ggetabscreateorfindpoint = GgETABSCreateOrFindPoint(Location=edit_node.NodePosition, PointAtts=ggetabspointatts, DetectTol=1)

# ----
# 1D Members
edit_1d_member = Edit1DMember(Member1D=get_model_geometry._1DMembersIn_mm, Preview3dSection=False)  # -> Member1D, Member1dNumber, Curve, Property, MemberGroup, MemberType, _1DElementType, Offset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
edit_bool6_2 = EditBool6(Bool6=edit_1d_member.EndRelease)  # -> Bool6, X, Y, Z, XX, YY, ZZ
edit_section = EditSection(Section=edit_1d_member.Property)  # -> Section, SectionNumber, SectionProfile, Material, BasicOffset, AddOffsetY_cm, AddOffsetZ_cm, SectionModifier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
edit_bool6_3 = EditBool6(Bool6=edit_1d_member.StartRelease)  # -> Bool6, X, Y, Z, XX, YY, ZZ
ggetabsframerelease = GgETABSFrameRelease(
    ReleaseX=edit_bool6_2.X,
    ReleaseY=edit_bool6_2.Y,
    ReleaseZ=edit_bool6_2.Z,
    ReleaseXx=edit_bool6_2.XX,
    ReleaseYy=edit_bool6_2.YY,
    ReleaseZz=edit_bool6_2.ZZ)
ggetabsframerelease_2 = GgETABSFrameRelease(
    ReleaseX=edit_bool6_3.X,
    ReleaseY=edit_bool6_3.Y,
    ReleaseZ=edit_bool6_3.Z,
    ReleaseXx=edit_bool6_3.XX,
    ReleaseYy=edit_bool6_3.YY,
    ReleaseZz=edit_bool6_3.ZZ)
python_3_script = Python3Script(x=edit_section.SectionProfile, y=edit_section.Material)  # -> flatten(out), a
# ---------- python_3_script: Python ----------
__author__ = "AbishekFestus.Winsto"
__version__ = "2025.07.25"

import rhinoscriptsyntax as rs
import re

# List of records
records = [x]

# Patterns for different types
patterns = [
    r'UB \d+x\d+x\d+',
    r'UC \d+x\d+x\d+',
    r'CHS\d+x\d+\.?\d*',
    r'STD R \d+ \d+',
    r'EA \d+x\d+x\d+'
]

# Extract and print all matching terms
for record in records:
    for pattern in patterns:
        match = re.search(pattern, record)
        if match:
            print(match.group().replace(" ", ""))
# ---------- end python_3_script ----------
edit_material = EditMaterial(Material=edit_section.Material)  # -> Material, MaterialID, MaterialName, CustomMaterial, MaterialType
ggetabsframeatts = GgETABSFrameAtts(
    ReleaseA=ggetabsframerelease_2,
    ReleaseB=ggetabsframerelease,
    TransformFrameStiff=False,
    DesignProcedure=0,
    LoadUnits=1,
    LowNodeID=1,
    LowFrameID=1,
    DetectTol=0)
ggetabsframepropparams = GgETABSFramePropParams(Color=RGBA(0, 0, 0, 0), AutoRigidZoneCol=False, ToleranceForGeometryDetection=0.01)
ggetabsmateriallibrary = GgETABSMaterialLibrary(Name=edit_material.MaterialName)  # -> flatten(Material)
ggsearchprofile = GgSearchProfile(Pattern=python_3_script.out)  # -> flatten(Profile)
ggetabscreateframeprop = GgETABSCreateFrameProp(Profile=ggsearchprofile, Material=ggetabsmateriallibrary, FramePropParams=ggetabsframepropparams)
ggetabscreateframe = GgETABSCreateFrame(
    FrameProp=ggetabscreateframeprop,
    NodeCL=flatten(edit_1d_member.Curve),
    Angle=edit_1d_member.OrientationAngle,
    Cardinal=edit_section.BasicOffset,
    Name=edit_1d_member.Member1dNumber,
    FrameAtts=ggetabsframeatts)

# ----
# 2D Members
edit_2d_member = Edit2DMember(Member2D=get_model_geometry._2DMembersIn_mm, Preview3dSection=False)  # -> Member2D, MemberNumber, Brep, InclPoints, InclCurves, _2DProperty, MemberGroup, MemberType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
edit_2d_property = Edit2DProperty(Property2D=edit_2d_member._2DProperty, LengthUnit="Millimeter", ReferenceEdge=0, SupportType=0)  # -> Property2D, Prop2dID, Name, Colour, Axis, Type, Material, Thickness_mm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
edit_material_2 = EditMaterial(Material=edit_2d_property.Material)  # -> Material, MaterialID, MaterialName, CustomMaterial, MaterialType
ggetabsmateriallibrary_2 = GgETABSMaterialLibrary(Name=edit_material_2.MaterialName)
ggetabscreate_slab_prop = GgETABSCreateSlabProp(
    Name=edit_2d_property.Name,
    Thickness=edit_2d_property.Thickness_mm,
    Material=ggetabsmateriallibrary_2,
    ShellType=1,
    OneWay=False)
ggetabscreateareaperimeter = GgETABSCreateAreaPerimeter(Prop=ggetabscreate_slab_prop, Perimeter=edit_2d_member.Brep)  # -> Area, Points

# ----
# Beam loads
get_model_loads = GetModelLoads(GSAModel=open_model, Unit="mm")  # -> LoadCases, GravityLoads, NodeLoads, BeamLoads, FaceLoads, GridPointLoads_mm, GridLineLoads_mm, GridAreaLoads_mm, GridPlaneSurfaces_mm
load_properties = LoadProperties(Load=get_model_loads.BeamLoads, Force_Unit="kN", Length_Unit="m")  # -> LoadCase, Name, Definition, Axis, Direction, Projected, LoadValueOrFactorX_kN_kN_mm_kN_mm², LoadValueOrFactorY_kN_kN_mm_kN_mm²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
text_split = TextSplit(Text=load_properties.Definition, Separators="(")
panel_6 = Panel(load_properties.LoadCase)
list_item = ListItem(List=text_split, Index=Slider(2, range=0..3), Wrap=True)
text_split_2 = TextSplit(Text=panel_6, Separators="(")
text_split_3 = TextSplit(Text=list_item, Separators=")")
list_item_2 = ListItem(List=text_split_3, Index=Slider(0, range=0..3), Wrap=True)  # -> flatten(Item)
panel_7 = Panel(list_item_2)
list_item_3 = ListItem(List=text_split_2, Index=Slider(1, range=0..3), Wrap=True)  # -> flatten(Item)
panel_8 = Panel("""to
 """)
ggetabsdecompose_frame = GgETABSDecomposeFrame(FrameElement=ggetabscreateframe)  # -> Prop, Axis, NodeA, NodeB, Orientation, Name, ID, Label, Storey
text_split_4 = TextSplit(Text=panel_7, Separators=panel_8)
text_split_5 = TextSplit(Text=list_item_3, Separators=")")
panel_9 = Panel(ggetabsdecompose_frame.Name)
list_item_4 = ListItem(List=text_split_4, Index="4", Wrap=True)
list_item_5 = ListItem(List=text_split_4, Index="0", Wrap=True)
list_item_6 = ListItem(List=text_split_5, Index=Slider(0, range=0..3), Wrap=True)  # -> flatten(Item)
expression = Expression(x=list_item_5, y=list_item_4, Expression="y - x + 1")
panel_10 = Panel(list_item_6)
text_split_6 = TextSplit(Text=panel_9)
series = Series(Start=list_item_5, Step=1, Count=expression)
list_item_7 = ListItem(List=text_split_6, Index="1", Wrap=True)  # -> flatten(Item)
panel_11 = Panel(series)
ggetabsloadpattern = GgETABSLoadPattern(Name=panel_10, Composition=7, SelfWeightMultiplier=0)
member_index = MemberIndex(Set=list_item_7, Member=panel_11)  # -> flatten(Index), Count
panel_12 = Panel(member_index.Index)
list_item_8 = ListItem(List=ggetabscreateframe, Index=panel_12, Wrap=True)
python_3_script_2 = Python3Script(x=load_properties.Direction)  # -> out, a
# ---------- python_3_script_2: Python ----------
__author__ = "AbishekFestus.Winsto"
__version__ = "2025.09.21"

import rhinoscriptsyntax as rs

direction = x

if direction =='X':
    a = 0
elif direction =='Y':
    a = 1
elif direction =='Z':
    a = 2
elif direction =='XX':
    a = 3
elif direction =='YY':
    a = 4
else:
    a = 5
# ---------- end python_3_script_2 ----------
ggetabsloadframeudl = GgETABSLoadFrameUDL(
    LoadPattern=ggetabsloadpattern,
    LoadedElements=list_item_8,
    LoadIntensity=load_properties.LoadValueOrFactorX_kN_kN_mm_kN_mm²,
    Direction=python_3_script_2.a,
    Projected=False,
    LocalAxis=False,
    LoadUnits=Slider(1, range=0..12))

# ----
# Nodal loads
get_model_loads_2 = GetModelLoads(GSAModel=open_model, Unit="mm")  # -> LoadCases, GravityLoads, NodeLoads, BeamLoads, FaceLoads, GridPointLoads_mm, GridLineLoads_mm, GridAreaLoads_mm, GridPlaneSurfaces_mm
load_properties_2 = LoadProperties(Load=get_model_loads_2.NodeLoads, Force_Unit="kN", Length_Unit="m")  # -> LoadCase, Name, Definition, Axis, Direction, Projected, LoadValueOrFactorX_kN_kN_mm_kN_mm², LoadValueOrFactorY_kN_kN_mm_kN_mm²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
text_split_7 = TextSplit(Text=load_properties_2.Definition, Separators="(")
list_item_9 = ListItem(List=text_split_7, Index=Slider(2, range=0..3), Wrap=True)
text_split_8 = TextSplit(Text=list_item_9, Separators=")")
ghpython_script = GhPythonScript(x=load_properties_2.Direction)  # -> out, a, b
# ---------- ghpython_script: Python ----------
__author__ = "AbishekFestus.Winsto"
__version__ = "2025.09.20"

import rhinoscriptsyntax as rs
# Ask the user to input list elements separated by spaces

user_input = (x)

#a = 0
#b = 0
#
#for item in user_input:
#    if item == 'X':
#        count_x += 1
#    elif item == 'Y':
#        count_y += 1

a = user_input.count('X')
b = user_input.count('Y')
# ---------- end ghpython_script ----------
mass_addition = MassAddition(Input=ghpython_script.a)  # -> Result, PartialResults
panel_13 = Panel(load_properties_2.LoadCase)
list_item_10 = ListItem(List=text_split_8, Index=Slider(0, range=0..3), Wrap=True)  # -> flatten(Item)
split_list = SplitList(List=list_item_10, Index=mass_addition.Result)  # -> ListA, ListB
split_list_2 = SplitList(List=load_properties_2.LoadValueOrFactorX_kN_kN_mm_kN_mm², Index=mass_addition.Result)  # -> ListA, ListB
panel_14 = Panel(split_list.ListA)
concatenate = Concatenate(FragmentA=panel_14, FragmentB=" ")
text_split_9 = TextSplit(Text=panel_13, Separators="(")
text_join = TextJoin(Text=concatenate)
panel_15 = Panel(text_join)
list_item_11 = ListItem(List=text_split_9, Index=Slider(1, range=0..3), Wrap=True)  # -> flatten(Item)
get_model_geometry_2 = GetModelGeometry(GSAModel=open_model, NodeFilterList=panel_15, Mode=1, Unit="mm")  # -> NodesIn_mm, _1DElementsIn_mm, _2DElementsIn_mm, _3DElementsIn_mm, _1DMembersIn_mm, _2DMembersIn_mm, _3DMembersIn_mm, Assemblies
text_split_10 = TextSplit(Text=list_item_11, Separators=")")
edit_node_2 = EditNode(Node=get_model_geometry_2.NodesIn_mm, Mode=1)  # -> Node, NodeNumber, NodePosition, NodeLocalAxis, NodeRestraints, DamperProperty, MassProperty, SpringProperty, NodeName, NodeColour
list_item_12 = ListItem(List=text_split_10, Index=Slider(0, range=0..3), Wrap=True)  # -> flatten(Item)
ggetabscreateorfindpoint_2 = GgETABSCreateOrFindPoint(Location=edit_node_2.NodePosition, DetectTol=1)
split_list_3 = SplitList(List=list_item_12, Index=mass_addition.Result)  # -> ListA, ListB
ggetabsloadpattern_2 = GgETABSLoadPattern(Name=split_list_3.ListA, Composition=7, SelfWeightMultiplier=0)
ggetabsloadpattern_3 = GgETABSLoadPattern(Name=split_list_3.ListB, Composition=7, SelfWeightMultiplier=0)
vector_xyz = VectorXYZ(XComponent=split_list_2.ListA, YComponent=0, ZComponent=0)  # -> Vector, Length
vector_xyz_2 = VectorXYZ(XComponent=0, YComponent=split_list_2.ListB, ZComponent=0)  # -> Vector, Length
number_slider = Slider(1, range=0..12)
ggetabsloadpoint = GgETABSLoadPoint(
    LoadPattern=ggetabsloadpattern_2,
    LoadedNodes=ggetabscreateorfindpoint_2,
    LoadDirectionAndMagnitude=vector_xyz.Vector,
    Units=number_slider)
ggetabsloadpoint_2 = GgETABSLoadPoint(
    LoadPattern=ggetabsloadpattern_3,
    LoadedNodes=ggetabscreateorfindpoint_2,
    LoadDirectionAndMagnitude=vector_xyz_2.Vector,
    Units=number_slider)

# ----
# Area loads
get_model_loads_3 = GetModelLoads(GSAModel=open_model, Unit="mm")  # -> LoadCases, GravityLoads, NodeLoads, BeamLoads, FaceLoads, GridPointLoads_mm, GridLineLoads_mm, GridAreaLoads_mm, GridPlaneSurfaces_mm
load_properties_3 = LoadProperties(Load=get_model_loads_3.FaceLoads, Force_Unit="kN", Length_Unit="mm")  # -> LoadCase, Name, Definition, Axis, Direction, Projected, LoadValueOrFactorX_kN_kN_mm_kN_mm², LoadValueOrFactorY_kN_kN_mm_kN_mm²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
text_split_11 = TextSplit(Text=load_properties_3.LoadCase, Separators="(")
list_item_13 = ListItem(List=text_split_11, Index=Slider(1, range=0..3), Wrap=True)  # -> flatten(Item)
text_split_12 = TextSplit(Text=list_item_13, Separators=")")
expression_2 = Expression(x=load_properties_3.Axis, Expression="If(x=0, False, True)")
list_item_14 = ListItem(List=text_split_12, Index=Slider(0, range=0..3), Wrap=True)  # -> flatten(Item)
python_3_script_3 = Python3Script(x=load_properties_3.Direction)  # -> out, a; same code as python_3_script_2
ggetabsloadpattern_4 = GgETABSLoadPattern(Name=list_item_14, Composition=7, SelfWeightMultiplier=0)
ggetabsloadareauniform = GgETABSLoadAreaUniform(
    LoadPattern=ggetabsloadpattern_4,
    LoadedElements=ggetabscreateareaperimeter.Area,
    LoadPressure=load_properties_3.LoadValueOrFactorX_kN_kN_mm_kN_mm²,
    Direction=python_3_script_3.a,
    LocalAxis=expression_2,
    Projected=False,
    PressureUnit=Slider(3, range=0..12))
