# Grasshopper definition Gerber Member.gh (Grasshopper 1.0.7)
# Copyright: Arup
# plug-ins: GSA

# ---- group: Section from catalogue profile and custom material
material = CreateCustomMaterial(
    ElasticModulus_MPa="210000",
    PoissonsRatio=".3",
    Density_kg_m³="7850",
    Material_Type="Steel",
    Stress_Unit="MPa",
    Density_Unit="kg/m³",
    Temperature_Unit="K")
profile = CreateProfile(
    Depth_mm="251.4",
    Width_mm="146.1",
    WebThk_mm="6",
    FlangeThk_mm="8.6",
    catalogueIndex=-1,
    inclSS=False,
    lengthUnit="Millimeter",
    mode="Other",
    Profile_type="I Beam Symmetrical",
    Measure="mm",
    typeIndex=-1)
section = CreateSection(Profile=profile, Material=material, Basic_Offset="Centroid")

# ----
pt = ConstructPoint(XCoordinate=0, YCoordinate=0, ZCoordinate=0)
pt_2 = ConstructPoint(XCoordinate=0, YCoordinate=Slider(28, range=0..100), ZCoordinate=0)
ln = Line(StartPoint=pt, EndPoint=pt_2)

# ---- group: Split even distance from start and end
number_slider = Slider(0.172, range=0.001..0.5)
subtraction = Subtraction(A="1", B=number_slider)
eval = EvaluateCurve(Curve=reparameterize(ln), Parameter=[number_slider, subtraction])  # -> Point, Tangent, Angle

# ----
end = EndPoints(Curve=ln)  # -> Start, End

# ---- group: Polyline from start, support and end points
merge = Merge(Data1=end.Start, Data2=eval.Point, Data3=end.End)
pline = PolyLine(Vertices=merge, Closed=False)

# ----
σa = CreateAnalysisCase(Name="Analysis case 1", Description="L1")
σt = CreateAnalysisTask(Name="A1", AnalysisCases=σa, Solver="Static")

# ---- group: Load
beamload = CreateBeamLoad(
    LoadCase=1,
    ElementList="all",
    Axis=0,
    Direction="z",
    Projected=False,
    Value_kN_m=Slider(-3.5, range=-5..0),
    Load_Type="Uniform",
    Unit="KilonewtonPerMeter")

# ----
mem1d = Create1DMember(
    Curve=pline,
    Property=section,
    Preview3dSection=False,
    x1=False,
    x2=False,
    xx1=False,
    xx2=False,
    y1=False,
    y2=False,
    yy1=False,
    yy2=False,
    z1=False,
    z2=False,
    zz1=False,
    zz2=False)

# ---- group: Support [Global coordinate system]
support = CreateSupport(Point=eval.Point, Plane=PlaneXY(0, 0, 0), x=True, xx=True, y=True, yy=True, z=True, zz=True)

# ----
analyse = AnalyseModel(
    GSAGeometryIn_m=flatten([support, mem1d]),
    Loads=beamload,
    AnalysisTasksCombinations=σt,
    Analyse=True,
    ReMesh=True,
    Tolerance=0.01,
    Geometry_Unit="Meter")  # -> Model, Errors, Warnings, Remarks, Log

# ---- group: Enter file path to save
save = SaveGSAModel(GSAModel=analyse.Model, Save=True)

# ----
selres = SelectResult(GSAModel=analyse.Model, Type="AnalysisCase", Case_ID="A1")
contour1d = Contour1DResults(
    Result=selres,
    IntermediatePoints=Slider(86, range=0..100),
    Scale=Slider(47, range=1..100),
    Display=3,
    Mode=0,
    energy="J",
    envelope="Absolute",
    force="N",
    legend=True,
    legendScale=1,
    length="mm",
    moment="N·m",
    noDec=0,
    Result_Type="Displacement",
    Component="Resolved |U|",
    slider=True,
    stress="MPa",
    val=250,
    valMax=1000,
    valMin=0)  # -> L, Colours, Values_mm
line = Line(contour1d.L)
end_2 = EndPoints(Curve=line)  # -> Start, End
width_of_beam_yy_mm = Slider(300, range=0..1000)
depth_of_beam_zz_mm = Slider(450, range=0..1000)
beamforces = BeamForcesAndMoments(
    Result=selres,
    ElementFilterList="All",
    IntermediatePoints=3,
    Max_Min="All",
    Force_Unit="Kilonewton",
    Moment_Unit="KilonewtonMeter")  # -> ForceX_kN, ForceY_kN, ForceZ_kN, ForceYZ_kN, MomentXX_kN_m, MomentYY_kN_m, MomentZZ_kN_m, MomentYYZZ_kN_m
cluster = Cluster(
    un_8=beamforces.ForceX_kN,
    un_7=beamforces.ForceY_kN,
    un_9=beamforces.ForceZ_kN,
    un_10=beamforces.MomentXX_kN_m,
    un_6=beamforces.MomentYY_kN_m,
    un_5=beamforces.MomentZZ_kN_m,
    A=depth_of_beam_zz_mm,
    A_2=width_of_beam_yy_mm)
von_mises_stress_n_mm2 = Panel(cluster)
flatten = FlattenTree(Tree=von_mises_stress_n_mm2, Path="{0}")
sort = SortList(Keys=flatten)  # -> reverse(Keys), ValuesA
item = ListItem(List=sort.Keys, Index=0, Wrap=True)
max_von_mises_stress_n_mm2 = Panel(item)

# ==== cluster Cluster
un = ClusterInput()
un_2 = ClusterInput()
un_3 = ClusterInput()
un_4 = ClusterInput()
un_5 = ClusterInput()
un_6 = ClusterInput()
un_7 = ClusterInput()
un_8 = ClusterInput()
un_9 = ClusterInput()
un_10 = ClusterInput()
convertunit = ConvertUnitNumber(UnitNumber=un, Select_output_unit="MillimeterToTheFourth")
convertunit_2 = ConvertUnitNumber(UnitNumber=un_2, Select_output_unit="MillimeterToTheFourth")
convertunit_3 = ConvertUnitNumber(UnitNumber=un_3, Select_output_unit="MillimeterToTheFourth")
convertunit_4 = ConvertUnitNumber(UnitNumber=un_4, Select_output_unit="SquareMillimeter")
convertunit_5 = ConvertUnitNumber(UnitNumber=un_5, Select_output_unit="NewtonMillimeter")
convertunit_6 = ConvertUnitNumber(UnitNumber=un_6, Select_output_unit="NewtonMillimeter")
convertunit_7 = ConvertUnitNumber(UnitNumber=un_7, Select_output_unit="Newton")
convertunit_8 = ConvertUnitNumber(UnitNumber=un_8, Select_output_unit="Newton")
convertunit_9 = ConvertUnitNumber(UnitNumber=un_9, Select_output_unit="Newton")
convertunit_10 = ConvertUnitNumber(UnitNumber=un_10, Select_output_unit="NewtonMillimeter")
num = Number(<missing>)
d1 = ClusterInput()
d2 = ClusterInput()
num_2 = Number(<missing>)
num_3 = Number(<missing>)
num_4 = Number(<missing>)
num_5 = Number(<missing>)
num_6 = Number(<missing>)
num_7 = Number(<missing>)
num_8 = Number(<missing>)
num_9 = Number(<missing>)

merge = Merge(Data1=d1, Data2=d2)
multiplication = Multiplication(A=num_4, B=merge)
item = ListItem(List=multiplication, Index=0, Wrap=True)  # -> Item, Item1

A = ClusterInput()

# ---- group: Section modulus - Wy
division = Division(A=A, B="2")
division_2 = Division(A=num, B=division)

# ----
A_2 = ClusterInput()

# ---- group: Section modulus - Wz
division_3 = Division(A=A_2, B="2")
division_4 = Division(A=num_3, B=division_3)

# ---- group: sigma - Ax (N/mm2)
division_5 = Division(A=num_6, B=num_4)

# ---- group: tau Y (N/mm2)
division_6 = Division(A=num_5, B=item.Item)

# ---- group: sigma - My (N/mm2)
division_7 = Division(A=num_8, B=division_2)

# ---- group: tau Z (N/mm2)
division_8 = Division(A=num_7, B=item.Item1)

# ---- group: sigma - Mz (N/mm2)
division_9 = Division(A=num_9, B=division_4)

# ----
expression = Expression(
    sigmaAx=division_5,
    sigmaMy=division_7,
    sigmaMz=division_9,
    tauY=division_6,
    tauZ=division_8,
    Expression="sqrt(sigmaAx^2 + sigmaMy^2 + sigmaMz^2 + 3*(tauY+tauZ)^2)")
R = ClusterOutput(expression)
