# Grasshopper definition Grid loads.gh (Grasshopper 1.0.7)
# plug-ins: GSA

# ----
# Inputs [m]
bay_width_x = Slider(6, range=0..10)
no_of_columns_x = Slider(4, range=0..10)
bay_width_y = Slider(5, range=0..10)
no_of_columns_y = Slider(5, range=0..10)
storey_height = Slider(4.5, range=0..10)
no_of_stories = Slider(3, range=0..10)

# ----
# Geometry
X = UnitX(Factor=bay_width_x)
pt = Point(Point(0, 0, 0))
arrlinear = LinearArray(Geometry=pt, Direction=X, Count=no_of_columns_x)  # -> Geometry, Transform
Y = UnitY(Factor=bay_width_y)
arrlinear_2 = LinearArray(Geometry=arrlinear.Geometry, Direction=Y, Count=no_of_columns_y)  # -> Geometry, Transform
Z = UnitZ(Factor=storey_height)
subtraction = Subtraction(A=no_of_columns_x, B=1)
subtraction_2 = Subtraction(A=no_of_columns_y, B=1)
series = Series(Start=storey_height, Step=storey_height, Count=no_of_stories)
arrlinear_3 = LinearArray(Geometry=arrlinear_2.Geometry, Direction=Z, Count=expr("X+1", no_of_stories))  # -> simplify(Geometry), Transform
multiplication = Multiplication(A=bay_width_y, B=subtraction_2)
multiplication_2 = Multiplication(A=bay_width_x, B=subtraction)
split = SplitTree(Data=arrlinear_3.Geometry, Masks=flatten("{?;?}[0]"))  # -> Positive, Negative
unit_z = UnitZ(Factor=series)
plane_surface = PlaneSurface(Plane=PlaneXY(0, 0, 0), XSize=multiplication_2, YSize=multiplication)
clean = CleanTree(RemoveNulls=True, RemoveInvalid=True, RemoveEmpty=False, Tree=split.Negative)
path_mapper = PathMapper(clean, source="{A;B}(i)", target="{A;i}(B)")
path_mapper_2 = PathMapper(clean, source="{A;B}(i)", target="{i;B}(A)")
move = Move(Geometry=plane_surface, Motion=unit_z)  # -> Geometry, Transform
pline = PolyLine(Vertices=arrlinear_3.Geometry, Closed=False)
pline_2 = PolyLine(Vertices=path_mapper, Closed=False)
pline_3 = PolyLine(Vertices=path_mapper_2, Closed=False)
clean_2 = CleanTree(RemoveNulls=True, RemoveInvalid=True, RemoveEmpty=False, Tree=split.Positive)
pt_2 = Point(flatten(clean_2))

# ---- group: Slabs/planes
boundary_surfaces = BoundarySurfaces(Edges=move.Geometry, UseTasks=True)

# ---- group: Columns
explode = Explode(Curve=pline, Recursive=True)  # -> simplify(flatten(Segments)), Vertices

# ---- group: Beams
explode_2 = Explode(Curve=pline_3, Recursive=True)  # -> simplify(flatten(Segments)), Vertices
explode_3 = Explode(Curve=pline_2, Recursive=True)  # -> simplify(flatten(Segments)), Vertices

# ----
# Members & Supports
panel = Panel("30000")
material = CreateCustomMaterial(
    ElasticModulus_MPa=panel,
    PoissonsRatio="0.3",
    Density_kg_m³="2500",
    Material_Type="Concrete",
    Stress_Unit="MPa",
    Density_Unit="kg/m³",
    Temperature_Unit="K")
profile = CreateProfile(
    Depth_mm=Slider(400, range=0..1000),
    Width_mm=Slider(400, range=0..1000),
    catalogueIndex=-1,
    inclSS=False,
    lengthUnit="Millimeter",
    mode="Other",
    Profile_type="Rectangle",
    Measure="mm",
    typeIndex=-1)
section = CreateSection(Profile=profile, Material=material, Basic_Offset="Centroid")
prop2d = Create2DProperty(Thickness_mm=Slider(200, range=0..1000), Material=material, Type="Shell", Unit="mm")
mem1d = Create1DMember(
    Curve=flatten([explode_3.Segments, explode_2.Segments, explode.Segments]),
    Property=section,
    Preview3dSection=False,
    x1=False,
    x2=False,
    xx1=False,
    xx2=False,
    y1=False,
    y2=False,
    yy1=False,
    yy2=False,
    z1=False,
    z2=False,
    zz1=False,
    zz2=False)
support = CreateSupport(Point=pt_2, Plane=PlaneXY(0, 0, 0), x=True, xx=True, y=True, yy=True, z=True, zz=True)
mem2d = Create2DMember(
    Brep=boundary_surfaces,
    Property2D=prop2d,
    InternalOffset=invert(True),
    Preview3dSection=False,
    Mesh_mode="Quad dominant")

# ----
# Grid loads
item = ListItem(List=boundary_surfaces, Index=0, Wrap=True)  # -> Item, Item1, Item2
xy = XYPlane(Origin=Point(0, 0, 0))
gridplane = CreateGridPlane(Plane=xy, GridPlaneID=0, GridElevationInModelUnits=series, Type="General")
gridsurface = CreateGridSurface(GridPlane=gridplane, GridSurfaceID=0, SpanDirection=0, Type="1D, One-way span")
item_2 = ListItem(List=gridsurface, Index=0, Wrap=True)  # -> Item, Item1, Item2

# ----
# Grid point loads
# Random points generated for grid point loads
number_slider = Slider(11, range=0..100)
number_slider_2 = Slider(8, range=0..100)
random = Random(Range=Domain(0, 1), Number=number_slider_2, Seed=number_slider)
random_2 = Random(Range=Domain(0, 1), Number=number_slider_2, Seed=Slider(32, range=0..100))
pt_3 = ConstructPoint(XCoordinate=random, YCoordinate=random_2, ZCoordinate=0)
evalsrf = EvaluateSurface(Surface=reparameterize(item.Item2), Point=pt_3)  # -> Point, Normal, UDirection, VDirection, Frame
list = ValueList({"x", "y", "z"}, selected="z")
pt_4 = Point(evalsrf.Point)
pointload = CreateGridPointLoad(
    LoadCase="3",
    Point=pt_4,
    GridPlaneSurface=item_2.Item2,
    Direction=list,
    Axis=Slider(0, range=0..1),
    Name="Point Load",
    Value_kN=Slider(-4.58, range=-10..0),
    ExpansionChanged=False,
    Mode=0,
    Unit="kN")

# ----
# Area for grid area loads
# Grid area loads
area = Area(Geometry=item.Item)  # -> Area, Centroid
scale = Scale(Geometry=item.Item, Center=area.Centroid, Factor=Slider(0.465, range=0..1))  # -> Geometry, Transform
vec = VectorXYZ(XComponent=Slider(1.824, range=0..10), YComponent=Slider(3.269, range=0..10), ZComponent=0)  # -> Vector, Length
move_2 = Move(Geometry=scale.Geometry, Motion=vec.Vector)  # -> Geometry, Transform
list_2 = ValueList({"x", "y", "z"}, selected="z")
areaload = CreateGridAreaLoad(
    LoadCase="1",
    Brep=move_2.Geometry,
    GridPlaneSurface=item_2.Item,
    Direction=list_2,
    Axis=Slider(0, range=0..1),
    Projected=Toggle(False),
    Name="Area Load",
    Value_kN_m²=Slider(-5.85, range=-10..0),
    ExpansionChanged=False,
    Mode=0,
    Unit="kN/m²")

# ----
# Grid line loads
number_slider_3 = Slider(-5, range=-10..0)
list_3 = ValueList({"x", "y", "z"}, selected="z")
crv = Curve([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])
lineload = CreateGridLineLoad(
    LoadCase="2",
    PolyLine=crv,
    GridPlaneSurface=item_2.Item1,
    Direction=list_3,
    Axis=Slider(0, range=0..1),
    Projected=Toggle(False),
    Name="Line Load",
    ValueStart_kN_m=Slider(-5, range=-10..0),
    ValueEnd_kN_m=number_slider_3,
    ExpansionChanged=False,
    Mode=0,
    Unit="kN/m")

# ----
# Analysis tasks
panel_2 = Panel("""Grid area loads
Grid line loads
Grid point loads""")
panel_3 = Panel("""L1
L2
L3""")
σa = CreateAnalysisCase(Name=panel_2, Description=panel_3)
σt = CreateAnalysisTask(TaskID="1", Name="Task-1", AnalysisCases=σa, casesParamIndex=2, Solver="Static")

analyse = AnalyseModel(
    GSAGeometryIn_m=flatten([mem1d, support, mem2d]),
    Load=[areaload, lineload, pointload],
    AnalysisTasksCombinations=σt,
    Analyse=True,
    ReMesh=True,
    Tolerance=0.001,
    Unit="m")  # -> Model, Errors, Warnings, Remarks, Log

save = SaveGSAModel(GSAModel=analyse.Model, Save=True, FileAndPath="C:\Temp\Grid loads.gwb")

loaddiagram = LoadDiagrams(
    GSAModel=analyse.Model,
    Annotation=False,
    SignificantDigits=3,
    force="kN",
    length="m",
    model="mm",
    Case_ID="A3",
    Load_Type="All")  # -> DiagramLines, Annotations
selres = SelectResults(GSAModel=analyse.Model, Type="AnalysisCase", Case_ID="A3")
reactforce = ReactionForces(Result=selres, Max_Min="All", Force_Unit="N", Moment_Unit="N·m")  # -> ForceX_N, ForceY_N, ForceZ_N, ForceXYZ_N, MomentXX_N_m, MomentYY_N_m, MomentZZ_N_m, MomentXXYYZZ_N_m, NodesIDs
contourelem1d = _1DContourResults(
    Result=selres,
    ElementFilterList="All",
    IntermediatePoints=10,
    Scale=10,
    Display=1,
    Mode=1,
    energy="MJ",
    envelope="Absolute",
    force="kN",
    legend=True,
    legendHeight=110,
    legendScale=1,
    legendWidth=120,
    length="mm",
    moment="kN·m",
    noDec=0,
    Result_Type="Force",
    Component="Shear Force Fy",
    slider=False,
    stress="MPa",
    val=0,
    valMax=1000,
    valMin=0)  # -> L, Colours, LegendValues_kN
panel_4 = Panel(reactforce.ForceXYZ_N)
panel_5 = Panel(reactforce.MomentXXYYZZ_N_m)
contour2d = Contour2DResults(
    Result=selres,
    Display=3,
    Mode=0,
    envelope="Absolute",
    flayer=0,
    force="kN/m",
    legend=True,
    legendHeight=110,
    legendScale=1,
    legendWidth=120,
    length="mm",
    model="m",
    moment="kN",
    noDec=0,
    Result_Type="Displacement",
    Component="Resolved |U|",
    slider=True,
    stress="MPa",
    val=0,
    valMax=1000,
    valMin=0)  # -> M, Colours, Values_mm
