# Grasshopper definition Inclined column tower.gh (Grasshopper 1.0.7)
# plug-ins: GSA

# ----
# Inputs
first_floor_height = Slider(4.5, range=0..10)
remaining_floor_height = Slider(3.6, range=0..10)
no_of_floors = Slider(7, range=0..10)

# ---- group: Slab corner points
number_slider = Slider(0, range=0..15)
number_slider_2 = Slider(0, range=0..15)
number_slider_3 = Slider(7, range=0..15)
number_slider_4 = Slider(8, range=0..15)
number_slider_5 = Slider(0, range=0..15)
number_slider_6 = Slider(5, range=0..15)
number_slider_7 = Slider(8, range=0..15)
number_slider_8 = Slider(0, range=0..15)

# ---- group: Column top end points (to be scaled)
genes = GenePool(Decimals=2, Maximum=1, Minimum=0, Value=[0.17, 0.74, 0.59, 0.86, 0.6, 0.84, 0.19])
genes_2 = GenePool(Decimals=2, Maximum=1, Minimum=0, Value=[0.7426895372, 0.1335594799, 0.738, 0.613, 0.432, 0.87, 0.07])

# ---- group: Column bottom start points (to be scaled)
genes_3 = GenePool(Decimals=2, Maximum=1, Minimum=0, Value=[0.06667321225, 0.843, 0.43, 0.992, 0.562, 0.876, 0.04828758866])
genes_4 = GenePool(Decimals=2, Maximum=1, Minimum=0, Value=[0.8014655713, 0.1410137779, 0.24, 0.5130655628, 0.4687065, 0.964, 0.2675101437])

# ----
pt = ConstructPoint(XCoordinate=number_slider, YCoordinate=number_slider_2, ZCoordinate=0)
pt_2 = ConstructPoint(XCoordinate=number_slider_3, YCoordinate=number_slider_4, ZCoordinate=0)
pt_3 = ConstructPoint(XCoordinate=genes_3, YCoordinate=genes_4, ZCoordinate=0)
pt_4 = ConstructPoint(XCoordinate=genes, YCoordinate=genes_2, ZCoordinate=0)
series = Series(Start=first_floor_height, Step=remaining_floor_height, Count=no_of_floors)
pt_5 = ConstructPoint(XCoordinate=number_slider_7, YCoordinate=number_slider_8, ZCoordinate=0)
Z = UnitZ(Factor=series)
pt_6 = ConstructPoint(XCoordinate=number_slider_5, YCoordinate=number_slider_6, ZCoordinate=0)
srf4pt = _4PointSurface(CornerA=pt, CornerB=pt_5, CornerC=pt_2, CornerD=pt_6)

profile = CreateProfile(
    Diameter_mm=Slider(250, range=0..1000),
    catalogueIndex=-1,
    inclSS=False,
    lengthUnit="Millimeter",
    mode="Other",
    Profile_type="Circle",
    Measure="mm",
    typeIndex=-1)
material = CreateCustomMaterial(
    ElasticModulus_MPa="210000",
    PoissonsRatio="0.2",
    Density_kg_m³="7850",
    Material_Type="Steel",
    Stress_Unit="MPa",
    Density_Unit="kg/m³",
    Temperature_Unit="°C")
section = CreateSection(Profile=profile, Material=material, Basic_Offset="Centroid")

move = Move(Geometry=srf4pt, Motion=Z)  # -> Geometry, Transform
evalsrf = EvaluateSurface(Surface=reparameterize(srf4pt), Point=pt_3)  # -> Point, Normal, UDirection, VDirection, Frame
item = ListItem(List=reverse(move.Geometry), Index=0, Wrap=True)

# ---- group: Loading
create_gravity_load = CreateGravityLoad(LoadCase="1", GravityFactor=Vector(0, 0, -1))
faceload = CreateFaceLoad(
    LoadCase="2",
    ElementList="PA",
    Axis=-1,
    Direction="z",
    Projected=False,
    Value_kN_m²=Slider(-4, range=-5..0),
    Load_Type="Uniform",
    Unit="KilonewtonPerSquareMeter")

# ----
material_2 = CreateCustomMaterial(
    ElasticModulus_MPa="30000",
    PoissonsRatio="0.3",
    Density_kg_m³="2500",
    Material_Type="Concrete",
    Stress_Unit="MPa",
    Density_Unit="kg/m³",
    Temperature_Unit="°C")
prop2d = Create2DProperty(Thickness_mm=Slider(180, range=0..1000), Material=material_2, Type="Shell", Unit="mm")

evalsrf_2 = EvaluateSurface(Surface=reparameterize(item), Point=pt_4)  # -> Point, Normal, UDirection, VDirection, Frame
ln = Line(StartPoint=evalsrf.Point, EndPoint=evalsrf_2.Point)

# ---- group: Analysis task
panel = Panel("""Dead loads
Face loads""")
panel_2 = Panel("""L1
L2""")
create_analysis_case = CreateAnalysisCase(Name=panel, Description=panel_2)
create_analysis_task = CreateAnalysisTask(TaskID="1", Name="DL + LL", AnalysisCases=create_analysis_case, casesParamIndex=2, Solver="Static")

# ----
support = CreateSupport(Point=evalsrf.Point, Plane=PlaneXY(0, 0, 0), x=True, xx=False, y=True, yy=False, z=True, zz=False)
mem1d = Create1DMember(
    Curve=ln,
    Property=section,
    Preview3dSection=False,
    x1=False,
    x2=False,
    xx1=False,
    xx2=False,
    y1=False,
    y2=False,
    yy1=False,
    yy2=False,
    z1=False,
    z2=False,
    zz1=False,
    zz2=False)
mem2d = Create2DMember(
    Brep=move.Geometry,
    Property2D=prop2d,
    MeshSizeInModelUnits=Slider(0.1, range=0..1.5),
    InternalOffset=True,
    Preview3dSection=False,
    Mesh_mode="Quad dominant")
analyse = AnalyseModel(
    GSAGeometryIn_m=flatten([support, mem2d, mem1d]),
    Loads=flatten([faceload, create_gravity_load]),
    AnalysisTasksCombinations=create_analysis_task,
    Analyse=True,
    ReMesh=True,
    Tolerance=0.01,
    Geometry_Unit="Meter")  # -> Model, Errors, Warnings, Remarks, Log

save = SaveGSAModel(GSAModel=analyse.Model, Save=True, FileAndPath="C:\Temp\Inclined column tower.gwb")

selres = SelectResults(GSAModel=analyse.Model, Type="AnalysisCase", Case_ID="A1")
contour2d = Contour2DResults(
    Result=selres,
    Display=3,
    Mode=0,
    envelope="Absolute",
    flayer=0,
    force="N/m",
    legend=True,
    legendHeight=110,
    legendScale=1,
    legendWidth=120,
    length="mm",
    model="mm",
    moment="N",
    noDec=0,
    Result_Type="Displacement",
    Component="Resolved |U|",
    slider=True,
    stress="Pa",
    val=0,
    valMax=1000,
    valMin=0)  # -> M, Colours, Values_mm
beamforces = BeamForcesAndMoments(
    Result=selres,
    ElementFilterList="All",
    IntermediatePoints=3,
    Max_Min="All",
    Force_Unit="Kilonewton",
    Moment_Unit="KilonewtonMeter")  # -> ForceX_kN, ForceY_kN, ForceZ_kN, ForceYZ_kN, MomentXX_kN_m, MomentYY_kN_m, MomentZZ_kN_m, MomentYYZZ_kN_m
contour1d = Contour1DResults(
    Result=selres,
    IntermediatePoints=10,
    Scale=10,
    Display=3,
    Mode=0,
    energy="J",
    envelope="Absolute",
    force="N",
    legend=True,
    legendHeight=110,
    legendScale=1,
    legendWidth=120,
    length="mm",
    moment="N·m",
    noDec=0,
    Result_Type="Displacement",
    Component="Resolved |U|",
    slider=True,
    stress="MPa",
    val=0,
    valMax=1000,
    valMin=0)  # -> L, Colours, Values_mm
panel_3 = Panel(beamforces.MomentYY_kN_m)
