# Grasshopper definition Member loading.gh (Grasshopper 1.0.7)
# plug-ins: GSA

# ----
# INPUT
# Crv -1 parameter is defined with a line
# 
# 1. Select Crv-1 and right-click > Bake
# 2. Select the line newly visible in Rhino on the 2D member and Cntrl+c to copy
# 3. Select Crv-2 and right-click > Set one Curve
# 4. Now you can adjust the 1D member in Rhino and get results parametrically
crv_1 = Curve(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)
crv_2 = Curve(crv_1)

material = CreateCustomMaterial(
    ElasticModulus_MPa="210000",
    PoissonsRatio="0.3",
    Density_kg_m³="7850",
    Material_Type="Steel",
    Stress_Unit="MPa",
    Density_Unit="kg/m³",
    Temperature_Unit="°C")
material_2 = CreateCustomMaterial(
    ElasticModulus_MPa="30000",
    PoissonsRatio="0.3",
    Density_kg_m³="2500",
    Material_Type="Concrete",
    Stress_Unit="MPa",
    Density_Unit="kg/m³",
    Temperature_Unit="°C")
profile = CreateProfile(
    catalogueIndex=2,
    inclSS=False,
    lengthUnit="Millimeter",
    mode="Catalogue",
    Profile_type="Catalogue",
    Catalogue="British",
    Type="Universal columns(UC) - EN10365:2017",
    Profile="BSI-UC UC254x254x73",
    typeIndex=256)
profile_2 = CreateProfile(
    catalogueIndex=2,
    inclSS=False,
    lengthUnit="Millimeter",
    mode="Catalogue",
    Profile_type="Catalogue",
    Catalogue="British",
    Type="Universal beams(UB) - EN10365:2017",
    Profile="BSI-UB UB305x102x25",
    typeIndex=255)
profile_3 = CreateProfile(
    catalogueIndex=2,
    inclSS=False,
    lengthUnit="Millimeter",
    mode="Catalogue",
    Profile_type="Catalogue",
    Catalogue="British",
    Type="Universal columns(UC) - EN10365:2017",
    Profile="BSI-UC UC254x254x73",
    typeIndex=256)
section = CreateSection(Profile=profile, Material=material, Basic_Offset="Centroid")
section_2 = CreateSection(Profile=profile_2, Material=material, Basic_Offset="Centroid")
section_3 = CreateSection(Profile=profile_3, Material=material, Basic_Offset="Centroid")
prop2d = Create2DProperty(Thickness_mm=Slider(100, range=0..100), Material=material_2, Type="Shell", Unit="mm")
curve = Curve([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])
curve_2 = Curve([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])
brep = Brep(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)
mem1d = Create1DMember(
    Curve=crv_2,
    Property=section,
    Preview3dSection=True,
    x1=False,
    x2=False,
    xx1=False,
    xx2=False,
    y1=False,
    y2=False,
    yy1=False,
    yy2=False,
    z1=False,
    z2=False,
    zz1=False,
    zz2=False)
mem1d_2 = Create1DMember(
    Curve=curve,
    Property=section_2,
    Preview3dSection=False,
    x1=False,
    x2=False,
    xx1=False,
    xx2=False,
    y1=False,
    y2=False,
    yy1=False,
    yy2=False,
    z1=False,
    z2=False,
    zz1=False,
    zz2=False)
mem1d_3 = Create1DMember(
    Curve=curve_2,
    Property=section_3,
    Preview3dSection=False,
    x1=False,
    x2=False,
    xx1=False,
    xx2=False,
    y1=False,
    y2=False,
    yy1=False,
    yy2=False,
    z1=False,
    z2=False,
    zz1=False,
    zz2=False)
mem2d = Create2DMember(
    Brep=brep,
    Property2D=prop2d,
    MeshSizeInModelUnits=Slider(0.5, range=0..1),
    InternalOffset=True,
    Preview3dSection=False,
    Mesh_mode="Quad dominant")
mem2dedit = Edit2DMember(Member2D=mem2d, InternalOffset=Toggle(False), Preview3dSection=False)  # -> Member2D, MemberNumber, Brep, InclPoints, InclCurves, _2DProperty, MemberGroup, MemberType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
mem1dedit = Edit1DMember(Member1D=mem1d, DummyMember=Toggle(False), Preview3dSection=False)  # -> Member1D, Member1dNumber, Curve, Property, MemberGroup, MemberType, _1DElementType, Offset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
end = EndPoints(Curve=mem1d)  # -> Start, End
point = Point([Point(2.250037734, 7, 0), Point(4.250037734, 2, 0), Point(9.250037734, 2, 0), Point(9.250037734, 7, 0)])
support = CreateSupport(Point=point, Plane=PlaneXY(0, 0, 0), x=True, xx=True, y=True, yy=True, z=True, zz=True)
support_2 = CreateSupport(Point=end.Start, Plane=PlaneXY(0, 0, 0), x=True, xx=True, y=True, yy=True, z=True, zz=True)

# ---- group: Uniform beam load (parametric)
beamload = CreateBeamLoad(
    LoadCase="2",
    ElementList=mem1dedit.Member1D,
    Axis=0,
    Direction="z",
    Projected=False,
    Value_kN_m=Slider(-63.7, range=-100..0),
    Type="Uniform",
    Unit="kN/m")

# ---- group: Uniform face loads
# Member loadings
panel = Panel("1")
faceload = CreateFaceLoad(
    LoadCase=panel,
    ElementList=mem2dedit.Member2D,
    Axis=-1,
    Direction="z",
    Projected=False,
    Value_kN_m²=Slider(-7.5, range=-100..0),
    Type="Uniform",
    Unit="kN/m²")

# ---- group: Patch beam load (parametric)
beamload_2 = CreateBeamLoad(
    LoadCase="3",
    ElementList=mem1dedit.Member1D,
    Axis=0,
    Direction="z",
    Projected=False,
    LoadT1_kN_m=Slider(-10, range=-100..0),
    Position1_=Slider(0.1, range=0..1),
    LoadT2_kN_m=Slider(-90, range=-100..0),
    Position2_=Slider(0.9, range=0..1),
    Type="Patch",
    Unit="kN/m")

# ----
# Analysis tasks
panel_2 = Panel("""Uniform face loads
Uniform beam loads
Patch beam loads""")
panel_3 = Panel("""L1
L2
L3""")
σa = CreateAnalysisCase(Name=panel_2, Description=panel_3)
σt = CreateAnalysisTask(TaskID="1", Name="Member loads", AnalysisCases=σa, casesParamIndex=2, Solver="Static")

analyse = AnalyseModel(
    GSAGeometryIn_m=flatten([mem1d_2, mem1d_3, support, mem1dedit.Member1D, support_2, mem2dedit.Member2D]),
    Load=flatten([beamload, faceload, beamload_2]),
    AnalysisTasksCombinations=σt,
    Analyse=True,
    ReMesh=True,
    Tolerance=0.001,
    Unit="m")  # -> Model, Errors, Warnings, Remarks, Log

save = SaveGSAModel(GSAModel=analyse.Model, Save=True, FileAndPath="C:\Temp\Member loading.gwb")

selres = SelectResults(GSAModel=analyse.Model, Type="AnalysisCase", Case_ID="A1")
contourelem2d = _2DContourResults(
    Result=selres,
    ElementFilterList="All",
    Display=4,
    Mode=1,
    envelope="Absolute",
    flayer=0,
    force="kN/m",
    legend=True,
    legendHeight=110,
    legendScale=1,
    legendWidth=120,
    length="mm",
    model="m",
    moment="kN",
    noDec=0,
    Result_Type="Force",
    Component="Moment Mx",
    slider=False,
    stress="MPa",
    val=0,
    valMax=1000,
    valMin=0)  # -> M, Colours, LegendValues_kN_m_m
contourelem1d = _1DContourResults(
    Result=selres,
    ElementFilterList="All",
    IntermediatePoints=10,
    Scale=10,
    Display=5,
    Mode=1,
    energy="MJ",
    envelope="Absolute",
    force="kN",
    legend=False,
    legendHeight=110,
    legendScale=1,
    legendWidth=120,
    length="mm",
    moment="kN·m",
    noDec=0,
    Result_Type="Force",
    Component="Moment Myy",
    slider=False,
    stress="MPa",
    val=0,
    valMax=1000,
    valMin=0)  # -> L, Colours, LegendValues_kN_m
beamforces = BeamForcesAndMoments(Result=selres, ElementFilterList="All", IntermediatePoints=3, Max_Min="All", Force_Unit="kN", Moment_Unit="kN·m")  # -> ForceX_kN, ForceY_kN, ForceZ_kN, ForceYZ_kN, MomentXX_kN_m, MomentYY_kN_m, MomentZZ_kN_m, MomentYYZZ_kN_m
myz = Panel(beamforces.MomentYYZZ_kN_m)
fyz = Panel(beamforces.ForceYZ_kN)
