# Grasshopper definition Moment frame structure.gh (Grasshopper 1.0.7)
# plug-ins: GSA, Pufferfish

# ----
# Inputs
bay_width_x = Slider(4.08, range=0..10)
no_of_bays_x = Slider(4, range=0..10)
bay_width_y = Slider(4.9, range=0..10)
no_of_bays_y = Slider(5, range=0..10)
storey_height = Slider(4.8, range=0..10)
no_of_storeys = Slider(5, range=0..10)

x_plus_one = XPlusOne(NumberX=no_of_bays_x)
X = UnitX(Factor=bay_width_x)
pt = Point(Point(0, 0, 0))
x_plus_one_2 = XPlusOne(NumberX=no_of_bays_y)
Y = UnitY(Factor=bay_width_y)
arrlinear = LinearArray(Geometry=pt, Direction=X, Count=x_plus_one)  # -> Geometry, Transform
Z = UnitZ(Factor=storey_height)
arrlinear_2 = LinearArray(Geometry=arrlinear.Geometry, Direction=Y, Count=x_plus_one_2)  # -> Geometry, Transform
arrlinear_3 = LinearArray(Geometry=arrlinear_2.Geometry, Direction=Z, Count=expr("X+1", no_of_storeys))  # -> simplify(Geometry), Transform
split = SplitTree(Data=arrlinear_3.Geometry, Masks=flatten("{?;?}[0]"))  # -> Positive, Negative
clean = CleanTree(RemoveNulls=True, RemoveInvalid=True, RemoveEmpty=False, Tree=split.Negative)
pline = PolyLine(Vertices=arrlinear_3.Geometry, Closed=False)
path_mapper = PathMapper(clean, source="{A;B}(i)", target="{i;B}(A)")
path_mapper_2 = PathMapper(clean, source="{A;B}(i)", target="{A;i}(B)")
clean_2 = CleanTree(RemoveNulls=True, RemoveInvalid=True, RemoveEmpty=False, Tree=split.Positive)
pt_2 = Point(flatten(clean_2))
pline_2 = PolyLine(Vertices=path_mapper, Closed=False)
pline_3 = PolyLine(Vertices=path_mapper_2, Closed=False)
support = CreateSupport(Point=pt_2, Plane=PlaneXY(0, 0, 0), x=True, xx=True, y=True, yy=True, z=True, zz=True)
explode = Explode(Curve=pline, Recursive=True)  # -> simplify(flatten(Segments)), Vertices
explode_2 = Explode(Curve=pline_3, Recursive=True)  # -> simplify(flatten(Segments)), Vertices
explode_3 = Explode(Curve=pline_2, Recursive=True)  # -> simplify(flatten(Segments)), Vertices

# ---- group: Columns
profile = CreateProfile(
    Depth_mm=Slider(300, range=0..1000),
    Width_mm=Slider(300, range=0..1000),
    catalogueIndex=-1,
    inclSS=False,
    lengthUnit="Millimeter",
    mode="Other",
    Profile_type="Rectangle",
    Measure="mm",
    typeIndex=-1)
mat = CreateMaterial(Material_type="Concrete", Design_Code="EC2 (GB)", Grade="C12/15")
section = CreateSection(Profile=profile, Material=mat, Basic_Offset="Centroid")
mem1d = Create1DMember(
    Curve=explode.Segments,
    Property=section,
    Preview3dSection=False,
    x1=False,
    x2=False,
    xx1=False,
    xx2=False,
    y1=False,
    y2=False,
    yy1=False,
    yy2=False,
    z1=False,
    z2=False,
    zz1=False,
    zz2=False)

# ---- group: Beams
profile_2 = CreateProfile(
    Depth_mm=Slider(319, range=0..1000),
    Width_mm=Slider(250, range=0..1000),
    catalogueIndex=-1,
    inclSS=False,
    lengthUnit="Millimeter",
    mode="Other",
    Profile_type="Rectangle",
    Measure="mm",
    typeIndex=-1)
profile_3 = CreateProfile(
    Depth_mm=Slider(299, range=0..1000),
    Width_mm=Slider(249, range=0..1000),
    catalogueIndex=-1,
    inclSS=False,
    lengthUnit="Millimeter",
    mode="Other",
    Profile_type="Rectangle",
    Measure="mm",
    typeIndex=-1)
mat_2 = CreateMaterial(Material_type="Concrete", Design_Code="EC2 (GB)", Grade="C12/15")
mat_3 = CreateMaterial(Material_type="Concrete", Design_Code="EC2 (GB)", Grade="C12/15")
section_2 = CreateSection(Profile=profile_2, Material=mat_2, Basic_Offset="Centroid")
section_3 = CreateSection(Profile=profile_3, Material=mat_3, Basic_Offset="Centroid")
mem1d_2 = Create1DMember(
    Curve=explode_3.Segments,
    Property=section_3,
    Preview3dSection=False,
    x1=False,
    x2=False,
    xx1=False,
    xx2=False,
    y1=False,
    y2=False,
    yy1=False,
    yy2=False,
    z1=False,
    z2=False,
    zz1=False,
    zz2=False)
mem1d_3 = Create1DMember(
    Curve=explode_2.Segments,
    Property=section_2,
    Preview3dSection=False,
    x1=False,
    x2=False,
    xx1=False,
    xx2=False,
    y1=False,
    y2=False,
    yy1=False,
    yy2=False,
    z1=False,
    z2=False,
    zz1=False,
    zz2=False)

# ----
createcase = CreateAnalysisCase(Name="Self Weight", Description="L1")
σt = CreateAnalysisTask(Name="A1", AnalysisCases=createcase, casesParamIndex=2, Solver="Static")

gravityload = CreateGravityLoad(LoadCase=null, GravityFactor=Vector(0, 0, -1))
analyse = AnalyseModel(
    GSAGeometryIn_m=flatten([support, mem1d, mem1d_3, mem1d_2]),
    Loads=gravityload,
    AnalysisTasksCombinations=σt,
    Analyse=True,
    ReMesh=True,
    Tolerance=0.01,
    Geometry_Unit="Meter")  # -> Model, Errors, Warnings, Remarks, Log

save = SaveGSAModel(GSAModel=analyse.Model, Save=True, FileAndPath="C:\Temp\Moment frame structure.gwb")

selres = SelectResults(GSAModel=analyse.Model, Type="AnalysisCase", Case_ID="A1")
contour1d = Contour1DResults(
    Result=selres,
    IntermediatePoints=10,
    Scale=10,
    Display=3,
    Mode=0,
    energy="J",
    envelope="Absolute",
    force="N",
    legend=True,
    legendScale=1,
    length="mm",
    moment="N·m",
    noDec=0,
    Result_Type="Displacement",
    Component="Resolved |U|",
    slider=True,
    stress="MPa",
    val=0,
    valMax=1000,
    valMin=0)  # -> L, Colours, Values_mm
beamforces = BeamForcesAndMoments(
    Result=selres,
    ElementFilterList="All",
    IntermediatePoints=3,
    Max_Min="All",
    Force_Unit="Kilonewton",
    Moment_Unit="KilonewtonMeter")  # -> ForceX_kN, ForceY_kN, ForceZ_kN, ForceYZ_kN, MomentXX_kN_m, MomentYY_kN_m, MomentZZ_kN_m, MomentYYZZ_kN_m
panel = Panel(beamforces.MomentYYZZ_kN_m)
