# Grasshopper definition Soil tunnel.gh (Grasshopper 1.0.7)
# plug-ins: GSA

# ----
# Inputs [m]
soil_width = Slider(15, range=0..100)
soil_depth = Slider(13, range=0..100)
concrete_shell_thickness = Slider(0.1, range=0..1)
tunnel_radius = Slider(2.2, range=0.5..10)
support_spacing = Slider(0.7, range=0..10)
load_size = Slider(3, range=0..100)
load_position = Slider(7, range=0..100)
loading_material_thickness = Slider(1, range=0..1)

# ---- group: Tunnel position
number_slider = Slider(0.3, range=0..1)
number_slider_2 = Slider(0.6, range=0..1)

# ----
addition = Addition(A=load_size, B=load_position)
neg = Negative(Value=soil_depth)
subtraction = Subtraction(A=addition, B=load_size)
pt = ConstructPoint(XCoordinate=0, YCoordinate=0, ZCoordinate=0)
pt_2 = ConstructPoint(XCoordinate=soil_width, YCoordinate=0, ZCoordinate=0)
pt_3 = ConstructPoint(XCoordinate=0, YCoordinate=0, ZCoordinate=neg)
pt_4 = ConstructPoint(XCoordinate=soil_width, YCoordinate=0, ZCoordinate=neg)
pt_5 = ConstructPoint(XCoordinate=subtraction, YCoordinate=0, ZCoordinate=0)
pt_6 = ConstructPoint(XCoordinate=addition, YCoordinate=0, ZCoordinate=0)
pt_7 = ConstructPoint(XCoordinate=addition, YCoordinate=0, ZCoordinate=load_size)
pt_8 = ConstructPoint(XCoordinate=subtraction, YCoordinate=0, ZCoordinate=load_size)
srf4pt = _4PointSurface(CornerA=pt, CornerB=pt_2, CornerC=pt_4, CornerD=pt_3)
srf4pt_2 = _4PointSurface(CornerA=pt_5, CornerB=pt_6, CornerC=pt_7, CornerD=pt_8)
pt_9 = Point([pt, pt_2])
pt_10 = ConstructPoint(XCoordinate=number_slider, YCoordinate=number_slider_2, ZCoordinate=0)
explode = Explode(Curve=srf4pt, Recursive=True)  # -> Segments, Vertices
evalsrf = EvaluateSurface(Surface=reparameterize(srf4pt), Point=pt_10)  # -> Point, Normal, UDirection, VDirection, Frame
item = ListItem(List=reverse(explode.Segments), Index=0, Wrap=True)
pl = PlaneNormal(Origin=evalsrf.Point, ZAxis=evalsrf.Normal)
cir = Circle(Plane=pl, Radius=tunnel_radius)
material = CreateCustomMaterial(
    ElasticModulus_MPa="16000",
    PoissonsRatio="0.3",
    Density_kg_m³="2450",
    Material_Type="Concrete",
    Stress_Unit="MPa",
    Density_Unit="kg/m³",
    Temperature_Unit="°C")
split = SplitBrep(Brep=srf4pt, Cutter=cir)
material_2 = CreateCustomMaterial(
    ElasticModulus_MPa="210000",
    PoissonsRatio="0.3",
    Density_kg_m³="7850",
    Material_Type="Steel",
    Stress_Unit="MPa",
    Density_Unit="kg/m³",
    Temperature_Unit="°C")
divlength = DivideLength(Curve=item, Length=support_spacing)  # -> Points, Tangents, Parameters
item_2 = ListItem(List=reverse(split), Index=0, Wrap=True)
prop2d = Create2DProperty(Thickness_m=concrete_shell_thickness, Material=material, Type="Shell", Unit="m")
prop2d_2 = Create2DProperty(Thickness_m=loading_material_thickness, Material=material_2, Type="Shell", Unit="m")
support = CreateSupport(Point=pt_9, Plane=PlaneXY(0, 0, 0), x=False, xx=False, y=True, yy=False, z=False, zz=False)
support_2 = CreateSupport(Point=divlength.Points, Plane=PlaneXY(0, 0, 0), x=True, xx=False, y=True, yy=False, z=True, zz=False)
mem2d = Create2DMember(
    Brep=item_2,
    InclPoints=divlength.Points,
    Property2D=prop2d,
    MeshSizeInModelUnits=support_spacing,
    InternalOffset=True,
    Preview3dSection=False,
    Mesh_mode="Quad dominant")
mem2d_2 = Create2DMember(
    Brep=srf4pt_2,
    Property2D=prop2d_2,
    MeshSizeInModelUnits=Slider(0.25, range=0..1),
    InternalOffset=True,
    Preview3dSection=False,
    Mesh_mode="Quad dominant")
gravityload = CreateGravityLoad(LoadCase=null, GravityFactor=Vector(0, 0, -1))
analyse = AnalyseModel(
    GSAGeometryIn_m=flatten([support, support_2, mem2d, mem2d_2]),
    Loads=gravityload,
    Analyse=True,
    ReMesh=True,
    Tolerance=0.001,
    Geometry_Unit="Meter")  # -> Model, Errors, Warnings, Remarks, Log

save = SaveGSAModel(GSAModel=analyse.Model, Save=True, FileAndPath="C:\Temp\Soil tunnel.gwb")

selres = SelectResults(GSAModel=analyse.Model, Type="AnalysisCase", Case_ID="A1")
contour2d = Contour2DResults(
    Result=selres,
    Display=3,
    Mode=0,
    envelope="Absolute",
    flayer=0,
    force="kN/m",
    legend=True,
    legendScale=1,
    length="m",
    model="mm",
    moment="kN",
    noDec=0,
    Result_Type="Displacement",
    Component="Resolved |U|",
    slider=True,
    stress="MPa",
    val=0,
    valMax=1000,
    valMin=0)  # -> M, Colours, Values_m
