# Grasshopper definition Spatial truss.gh (Grasshopper 1.0.7)
# plug-ins: treesloth01, GSA

# ----
# Inputs
truss_length = Slider(21.82, range=0..100)
truss_height = Slider(3.19, range=0..10)
number_of_diagonals = Slider(5, range=0..100)
bay_width = Slider(5.29, range=0..100)
number_of_bays = Slider(3, range=0..100)
pt = Point(Point(0, 0, 0))

X = UnitX(Factor=bay_width)

# ----
# Section Properties
chord_wall_thickness = Slider(8, range=0..10)
dihedrals_wall_thickness = Slider(5, range=0..10)
diagonals_wall_thickness = Slider(6, range=0..10)
verticals_wall_thickness = Slider(6, range=0..10)
purlins_wall_thickness = Slider(5, range=0..10)
chord_diameter = Slider(65, range=0..100)
diagonals_diameter = Slider(27, range=0..100)
verticals_diameter = Slider(27, range=0..100)
purlins_diameter = Slider(25.5, range=0..100)
dihedrals_diameter = Slider(25.5, range=0..100)
entwine = Entwine(
    Branch00=chord_diameter,
    Branch01=diagonals_diameter,
    Branch02=verticals_diameter,
    Branch03=dihedrals_diameter,
    Branch04=purlins_diameter,
    FlattenInputs=True)  # -> simplify(Result)
entwine_2 = Entwine(
    Branch00=chord_wall_thickness,
    Branch01=diagonals_wall_thickness,
    Branch02=verticals_wall_thickness,
    Branch03=dihedrals_wall_thickness,
    Branch04=purlins_wall_thickness,
    FlattenInputs=True)  # -> simplify(Result)
profile = CreateProfile(
    Diameter_cm=entwine,
    Thickness_cm=entwine_2,
    catalogueIndex=-1,
    inclSS=False,
    lengthUnit="Centimeter",
    mode="Other",
    Profile_type="Circle Hollow",
    Measure="cm",
    typeIndex=-1)

material = CreateCustomMaterial(
    ElasticModulus_MPa="210000",
    PoissonsRatio="0.2",
    Density_kg_m³="7800",
    Material_Type="Steel",
    Stress_Unit="MPa",
    Density_Unit="kg/m³",
    Temperature_Unit="K")
section = CreateSection(Profile=profile, Material=material, Basic_Offset="Centroid")
entwine_3 = Entwine(Branch00="1", Branch01="2", Branch02="3", Branch03="4", Branch04="5", FlattenInputs=True)  # -> simplify(Result)
gravityload = CreateGravityLoad(LoadCase=null, GravityFactor=Vector(0, 0, -1))

# ----
# Generating Truss face 1
Y = UnitY(Factor=truss_length)
move = Move(Geometry=pt, Motion=Y)  # -> Geometry, Transform
merge = Merge(Data1=pt, Data2=move.Geometry)
Z = UnitZ(Factor=truss_height)
intcrv = Interpolate(Vertices=merge, Degree=3, Periodic=False, KnotStyle=1)  # -> Curve, Length, Domain
move_2 = Move(Geometry=intcrv.Curve, Motion=Z)  # -> Geometry, Transform
panel = Panel("""{0}[0,2,...]
{1}[1,3,...]""")
panel_2 = Panel("""{1}[0]
{1}[-1]""")

# ---- group: Truss chords
merge_2 = Merge(Data1=intcrv.Curve, Data2=move_2.Geometry)  # -> simplify(graft(Result))

# ----
divide = DivideCurve(Curve=reparameterize(merge_2), Count=number_of_diagonals, Kinks=False)  # -> simplify(Points), Tangents, Parameters
split = SplitTree(Data=divide.Points, Masks=flatten(panel))  # -> Positive, Negative
relitem = RelativeItem(Tree=divide.Points, Offset="{1}[0]", WrapPaths=False, WrapItems=False)  # -> ItemA, ItemB
clean = CleanTree(RemoveNulls=True, RemoveInvalid=True, RemoveEmpty=False, Tree=split.Positive)
relitem_2 = RelativeItem(Tree=clean, Offset=panel_2, WrapPaths=False, WrapItems=False)  # -> ItemA, ItemB

# ---- group: Truss diagonals
ln = Line(StartPoint=relitem_2.ItemA, EndPoint=relitem_2.ItemB)

# ---- group: Truss verticals
ln_2 = Line(StartPoint=relitem.ItemA, EndPoint=relitem.ItemB)

# ---- group: Truss face 1
entwine_4 = Entwine(Branch00=merge_2, Branch01=ln, Branch02=ln_2, FlattenInputs=True)  # -> simplify(Result)

# ----
split_2 = SplitTree(Data=entwine_4, Masks=flatten("{0}[0]"))  # -> Positive, Negative
crv = Curve(split_2.Negative)
clean_2 = CleanTree(RemoveNulls=True, RemoveInvalid=True, RemoveEmpty=False, Tree=crv)

# ---- group: Truss face 2
Y_2 = UnitY(Factor=1)
rot3d = Rotate3D(Geometry=clean_2, Angle=degrees(Slider(49.36, range=-90..90)), Center=Point(0, 0, 0), Axis=Y_2)  # -> Geometry, Transform

# ---- group: Assembly
merge_3 = Merge(Data1=entwine_4, Data2=rot3d.Geometry)

# ----
# Generating Truss face 3
panel_3 = Panel("""1
2""")
item = TreeItem(Tree=merge_3, Path="{0}", Index=panel_3, Wrap=True)
divide_2 = DivideCurve(Curve=reparameterize(item), Count=number_of_diagonals, Kinks=False)  # -> simplify(Points), Tangents, Parameters
panel_4 = Panel("""{0}[0,2,...]
{1}[1,3,...]""")
split_3 = SplitTree(Data=divide_2.Points, Masks=flatten(panel_4))  # -> Positive, Negative
panel_5 = Panel("""{1}[0]
{1}[-1]""")
relitem_3 = RelativeItem(Tree=divide_2.Points, Offset="{1}[0]", WrapPaths=False, WrapItems=False)  # -> ItemA, ItemB
clean_3 = CleanTree(RemoveNulls=True, RemoveInvalid=True, RemoveEmpty=False, Tree=split_3.Positive)
relitem_4 = RelativeItem(Tree=clean_3, Offset=panel_5, WrapPaths=False, WrapItems=False)  # -> ItemA, ItemB

# ---- group: Truss diagonals
ln_3 = Line(StartPoint=relitem_4.ItemA, EndPoint=relitem_4.ItemB)

# ---- group: Truss verticals
ln_4 = Line(StartPoint=relitem_3.ItemA, EndPoint=relitem_3.ItemB)

# ----
entwine_5 = Entwine(Branch01=ln_3, Branch02=ln_4, FlattenInputs=True)  # -> simplify(Result)

# ---- group: Assembly
merge_4 = Merge(Data1=merge_3, Data2=entwine_5)

# ---- group: Array
arrlinear = LinearArray(Geometry=merge_4, Direction=X, Count=number_of_bays)  # -> Geometry, Transform

# ----
# Generating Purlins and Dihedrals
panel_6 = Panel("{0;*}")
split_4 = SplitTree(Data=arrlinear.Geometry, Masks=flatten(panel_6))  # -> Positive, Negative
divide_3 = DivideCurve(Curve=split_4.Positive, Count=number_of_diagonals, Kinks=False)  # -> simplify(Points), Tangents, Parameters
flip = FlipMatrix(Data=split_4.Positive)
item_2 = ListItem(List=flip, Index=0, Wrap=True)
split_5 = SplitTree(Data=divide_3.Points, Masks=flatten("{1;*}"))  # -> Positive, Negative
split_6 = SplitTree(Data=divide_3.Points, Masks=flatten("{(0,2);*}"))  # -> Positive, Negative
flip_2 = FlipMatrix(Data=split_5.Positive)
end = EndPoints(Curve=item_2)  # -> flatten(Start), flatten(End)
relitem_5 = RelativeItem(Tree=split_6.Positive, Offset="{2;-1}", WrapPaths=False, WrapItems=False)  # -> ItemA, ItemB

# ---- group: Purlins
pline = PolyLine(Vertices=flip_2, Closed=False)

# ---- group: Dihedrals
ln_5 = Line(StartPoint=relitem_5.ItemA, EndPoint=relitem_5.ItemB)

# ----
merge_5 = Merge(Data1=ln_5, Data2=pline)
path_mapper = PathMapper(merge_5, source="{A;B}", target="{A+3;B}")
merge_6 = Merge(Data1=arrlinear.Geometry, Data2=path_mapper)

# ---- group: Final geometry
shift = ShiftPaths(Data=merge_6, Offset=-1)

# ----
pt_2 = Point(end.Start)
mem1d = Create1DMember(
    Curve=shift,
    Property=section,
    Preview3dSection=False,
    x1=False,
    x2=False,
    xx1=False,
    xx2=False,
    y1=False,
    y2=False,
    yy1=False,
    yy2=False,
    z1=False,
    z2=False,
    zz1=False,
    zz2=False)
support = CreateSupport(Point=pt_2, Plane=PlaneXY(0, 0, 0), x=True, xx=False, y=True, yy=False, z=True, zz=False)
mem1dedit = Edit1DMember(Member1D=mem1d, Member1dGroup=entwine_3, Preview3dSection=False)  # -> Member1D, Member1dNumber, Curve, Property, MemberGroup, MemberType, _1DElementType, Offset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
pt_3 = Point(end.End)
support_2 = CreateSupport(Point=pt_3, Plane=PlaneXY(0, 0, 0), x=True, xx=False, y=False, yy=True, z=True, zz=False)
flatten = FlattenTree(Tree=mem1dedit.Member1D, Path="{0}")
relay = Relay([support_2, support])
analyse = AnalyseModel(
    GSAGeometryIn_m=flatten([relay, flatten]),
    Loads=gravityload,
    Analyse=True,
    ReMesh=True,
    Tolerance=0.01,
    Geometry_Unit="Meter")  # -> Model, Errors, Warnings, Remarks, Log

save = SaveGSAModel(GSAModel=analyse.Model, Save=True, FileAndPath="C:\Temp\Spatial truss.gwb")

selres = SelectResult(GSAModel=analyse.Model, Type="AnalysisCase", Case_ID="A1")
nodecontour = ContourNodeResults(
    Result=selres,
    Scalar=10,
    Display=3,
    Mode=0,
    envelope="Absolute",
    force="N",
    legend=True,
    legendScale=1,
    length="mm",
    moment="N·m",
    noDec=0,
    Result_Type="Displacement",
    Component="Resolved |U|",
    slider=True,
    val=0,
    valMax=1000,
    valMin=0)  # -> P, Colours, Values_mm
contour1d = Contour1DResults(
    Result=selres,
    IntermediatePoints=10,
    Scale=10,
    Display=3,
    Mode=0,
    energy="J",
    envelope="Absolute",
    force="N",
    legend=True,
    legendScale=1,
    length="mm",
    moment="N·m",
    noDec=0,
    Result_Type="Displacement",
    Component="Resolved |U|",
    slider=True,
    stress="MPa",
    val=0,
    valMax=1000,
    valMin=0)  # -> L, Colours, Values_mm
reactforce = ReactionForces(Result=selres, Max_Min="All", Force_Unit="N", Moment_Unit="N·m")  # -> ForceX_N, ForceY_N, ForceZ_N, ForceXYZ_N, MomentXX_N_m, MomentYY_N_m, MomentZZ_N_m, MomentXXYYZZ_N_m, NodesIDs
panel_7 = Panel(reactforce.ForceX_N)
