# Grasshopper definition Spring and link.gh (Grasshopper 1.0.7)
# Copyright: Arup
# plug-ins: GSA

# ----
# Download the 'Link seed' GSA model file and
# add its location in the below panel or use
# the 'Open' command to get the link property
panel = Panel("C:\Temp\Link seed.gwb")
open = OpenModel(FilenameAndPath=panel)

# ----
# Inputs
column_height = Slider(7.37, range=0..100)
spring_height = Slider(1.9, range=0..100)
link_length = Slider(1.81, range=0..100)

Z = UnitZ(Factor=1)
profile = CreateProfile(
    Depth_mm="400",
    Width_mm="400",
    catalogueIndex=-1,
    inclSS=False,
    lengthUnit="Millimeter",
    mode="Other",
    Profile_type="Rectangle",
    Measure="mm",
    typeIndex=-1)
merge = Merge(Data1=column_height, Data2=spring_height)
neg = Negative(Value=Z)
pt = ConstructPoint(XCoordinate=0, YCoordinate=0, ZCoordinate=0)
merge_2 = Merge(Data1=Z, Data2=neg)
line = LineSDL(Start=pt, Direction=merge_2, Length=merge)
material = CreateCustomMaterial(
    ElasticModulus_MPa="30000",
    PoissonsRatio="0.2",
    Density_kg_m³="2500",
    Material_Type="Concrete",
    Stress_Unit="MPa",
    Density_Unit="kg/m³",
    Temperature_Unit="°C")
Y = UnitY(Factor=link_length)
item = ListItem(List=line, Index=0, Wrap=True)  # -> Item, Item1
end = EndPoints(Curve=line)  # -> Start, End
move = Move(Geometry=item.Item, Motion=Y)  # -> Geometry, Transform
section = CreateSection(Profile=profile, Material=material, Basic_Offset="Centroid")
end_2 = EndPoints(Curve=[item.Item, move.Geometry])  # -> Start, End
item_2 = ListItem(List=[end.End, end_2.Start], Index=0, Wrap=True)  # -> Item, Item1, Item2, Item3, Item4
pline = PolyLine(Vertices=end_2.End, Closed=False)
sectionmodifier = CreateSectionModifier(
    I11Modifier=Slider(0.6, range=0..1),
    I22Modifier=Slider(0.7, range=0..1),
    PrincipalBendingAxis=False,
    ReferencePointCentroid=False,
    Modify_type="Modify by",
    Density_unit="KilogramPerMeter",
    Stress_calc="Don't calculate",
    toMode=False)
pt_2 = Point([item_2.Item1, item_2.Item3])
spring = CreateSpringProperty(
    Name="Spring prop 1",
    StiffnessX_kN_m="100000",
    StiffnessXx_kN_m_rad="10000",
    Type="General",
    Stiffness_Unit="kN/m",
    Rotational_Stiffness_Unit="kN·m/rad")
editpb = EditSection(Section=section, SectionModifier=sectionmodifier)  # -> Section, SectionNumber, SectionProfile, Material, BasicOffset, AddOffsetY_cm, AddOffsetZ_cm, SectionModifier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
mem1d = Create1DMember(
    Curve=pline,
    Preview3dSection=False,
    x1=False,
    x2=False,
    xx1=False,
    xx2=False,
    y1=False,
    y2=False,
    yy1=False,
    yy2=False,
    z1=False,
    z2=False,
    zz1=False,
    zz2=False)
mem1d_2 = Create1DMember(
    Curve=item.Item1,
    Preview3dSection=False,
    x1=False,
    x2=False,
    xx1=False,
    xx2=False,
    y1=False,
    y2=False,
    yy1=False,
    yy2=False,
    z1=False,
    z2=False,
    zz1=False,
    zz2=False)
mem1dedit = Edit1DMember(Member1D=mem1d, Property="1", _1DElementType="9", Preview3dSection=False)  # -> Member1D, Member1dNumber, Curve, Property, MemberGroup, MemberType, _1DElementType, Offset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
mem1dedit_2 = Edit1DMember(Member1D=mem1d_2, Property=spring, Preview3dSection=False)  # -> Member1D, Member1dNumber, Curve, Property, MemberGroup, MemberType, _1DElementType, Offset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
support = CreateSupport(Point=pt_2, Plane=PlaneXY(0, 0, 0), x=True, xx=True, y=True, yy=True, z=True, zz=True)
mem1d_3 = Create1DMember(
    Curve=[move.Geometry, item.Item],
    Property=editpb.Section,
    Preview3dSection=False,
    x1=False,
    x2=False,
    xx1=False,
    xx2=False,
    y1=False,
    y2=False,
    yy1=False,
    yy2=False,
    z1=False,
    z2=False,
    zz1=False,
    zz2=False)
nodeload = CreateNodeLoad(
    LoadCase=1,
    NodeList="4",
    Direction="x",
    Value_kN=Slider(9, range=0..100),
    Load_Type="Node",
    Force_Unit="Kilonewton",
    Length_Unit="Meter")
analyse = AnalyseModel(
    ModelS=open,
    GSAGeometryIn_m=flatten([support, mem1d_3, mem1dedit_2.Member1D, mem1dedit.Member1D]),
    Loads=nodeload,
    Analyse=True,
    ReMesh=True,
    Tolerance=0.001,
    Geometry_Unit="Meter")  # -> Model, Errors, Warnings, Remarks, Log

save = SaveGSAModel(GSAModel=analyse.Model, Save=True, FileAndPath="C:\Temp\Spring and link.gwb")

selres = SelectResults(GSAModel=analyse.Model, Type="AnalysisCase", Case_ID="A1")
nodecontour = ContourNodeResults(
    Result=selres,
    NodeFilterList="1 2",
    Scalar=10,
    Display=0,
    Mode=1,
    envelope="Absolute",
    force="N",
    legend=True,
    legendScale=1,
    length="m",
    moment="kN·m",
    noDec=0,
    Result_Type="Reaction",
    Component="Reaction Fx",
    slider=False,
    val=0,
    valMax=1000,
    valMin=0)  # -> P, Colours, Values_N
contour1d = Contour1DResults(
    Result=selres,
    ElementMemberFilterList="1 2",
    IntermediatePoints=10,
    Scale=10,
    Display=3,
    Mode=0,
    energy="MJ",
    envelope="Absolute",
    force="kN",
    legend=True,
    legendScale=1,
    length="mm",
    moment="kN·m",
    noDec=0,
    Result_Type="Displacement",
    Component="Resolved |U|",
    slider=True,
    stress="MPa",
    val=0,
    valMax=1000,
    valMin=0)  # -> L, Colours, Values_mm
reactforce = ReactionForces(Result=selres, NodeFilterList="2", Max_Min="All", Force_Unit="kN", Moment_Unit="kN·m")  # -> ForceX_kN, ForceY_kN, ForceZ_kN, ForceXYZ_kN, MomentXX_kN_m, MomentYY_kN_m, MomentZZ_kN_m, MomentXXYYZZ_kN_m, NodesIDs
panel_2 = Panel([reactforce.ForceX_kN, reactforce.ForceY_kN, reactforce.ForceZ_kN, reactforce.ForceXYZ_kN, reactforce.MomentXX_kN_m, reactforce.MomentYY_kN_m, reactforce.MomentZZ_kN_m, reactforce.MomentXXYYZZ_kN_m, reactforce.NodesIDs])
