# Grasshopper definition Staircase.gh (Grasshopper 1.0.7)
# Copyright: Arup
# plug-ins: GSA

# ----
# Inputs [m]
tread = Slider(0.35, range=0..1)
no_of_treads = Slider(22, range=0..100)
rise = Slider(0.23, range=0..1)
width = Slider(3.02, range=0..10)
depth_of_stringer = Slider(-0.28, range=-1..0)

pt = ConstructPoint(XCoordinate=0, YCoordinate=0, ZCoordinate=0)
division = Division(A=rise, B=tread)
X = UnitX(Factor=tread)
series = Series(Start=0, Step=1, Count=no_of_treads)
arrlinear = LinearArray(Geometry=pt, Direction=X, Count=no_of_treads)  # -> Geometry, Transform
multiplication = Multiplication(A=tread, B=series)
multiplication_2 = Multiplication(A=multiplication, B=division)
Z = UnitZ(Factor=multiplication_2)
move = Move(Geometry=arrlinear.Geometry, Motion=Z)  # -> Geometry, Transform
Z_2 = UnitZ(Factor=expr("x*-1", rise))
cull_i = CullIndex(List=move.Geometry, Indices="0", Wrap=True)
Y = UnitY(Factor=width)
move_2 = Move(Geometry=cull_i, Motion=Z_2)  # -> Geometry, Transform
Z_3 = UnitZ(Factor=depth_of_stringer)
weave = Weave(Pattern=[0, 1], Stream0=move.Geometry, Stream1=move_2.Geometry, NullGaps=False)
pline = PolyLine(Vertices=weave, Closed=False)
end = EndPoints(Curve=pline)  # -> Start, End
move_3 = Move(Geometry=pline, Motion=Y)  # -> Geometry, Transform
ln = Line(StartPoint=end.Start, EndPoint=end.End)
loft = Loft(
    Curves=[pline, move_3.Geometry],
    Options={Adjust=False, Closed=False, LoftEnds=0, LoftSimp=0, LoftType=0, Rebuild=10, Refit=0.01})
move_4 = Move(Geometry=ln, Motion=Z_3)  # -> Geometry, Transform
debrep = DeconstructBrep(Brep=loft)  # -> Faces, Edges, Vertices
loft_2 = Loft(
    Curves=[ln, move_4.Geometry],
    Options={Adjust=False, Closed=False, LoftEnds=0, LoftSimp=0, LoftType=0, Rebuild=10, Refit=0.01})
material = CreateCustomMaterial(
    ElasticModulus_MPa="210000",
    PoissonsRatio="0.2",
    Density_kg_m³="7850",
    Material_Type="Steel",
    Stress_Unit="MPa",
    Density_Unit="kg/m³",
    Temperature_Unit="°C")
move_5 = Move(Geometry=loft_2, Motion=Y)  # -> Geometry, Transform
dispatch = Dispatch(List=debrep.Faces, DispatchPattern=[True, False])  # -> ListA, ListB
tread_2 = Brep(dispatch.ListB)
stringers = Brep([move_5.Geometry, loft_2])
riser = Brep(dispatch.ListA)
prop2d = Create2DProperty(Thickness_mm=Slider(2, range=0..10), Material=material, Type="Shell", Unit="mm")
prop2d_2 = Create2DProperty(Thickness_mm=Slider(2, range=0..10), Material=material, Type="Shell", Unit="mm")
prop2d_3 = Create2DProperty(Thickness_mm=Slider(10, range=0..10), Material=material, Type="Shell", Unit="mm")
entwine = Entwine(Branch00=riser, Branch01=tread_2, Branch02=stringers, FlattenInputs=True)
number_slider = Slider(0.1, range=0..1)
entwine_2 = Entwine(Branch00=prop2d, Branch01=prop2d_2, Branch02=prop2d_3, FlattenInputs=True)
mem2d = Create2DMember(
    Brep=entwine,
    Property2D=entwine_2,
    MeshSizeInModelUnits="0.05",
    InternalOffset=True,
    Preview3dSection=False,
    Mesh_mode="Quad dominant")
elemfrommem = ElementsFromMembers(_2DMembers_mm=mem2d, Tolerance=0.001, Unit="m")  # -> Nodes, _1DElements, _2DElements, _3DElements, GSAModel
mjoin = MeshJoin(Meshes=flatten(elemfrommem._2DElements))
flatten = FlattenTree(Tree=mem2d, Path="{0}")
demesh = DeconstructMesh(Mesh=mjoin)  # -> Vertices, Faces, Colours, Normals
branch = TreeBranch(Tree=simplify(elemfrommem._2DElements), Path="1", MaintainPaths=True)
pdecon = Deconstruct(Point=demesh.Vertices)  # -> XComponent, YComponent, ZComponent
demesh_2 = DeconstructMesh(Mesh=branch)  # -> Vertices, Faces, Colours, Normals
sort = SortList(Keys=pdecon.ZComponent)  # -> reverse(Keys), ValuesA

# ----
# This list can be used for setting up excitation
# nodes for footfall analysis in GSA main.
panel = Panel(" Tread Nodes")
createlist = CreateList(Index=0, Name=panel, Definition=flatten(demesh_2.Vertices), Type="Node")

equals = Equality(FirstNumber=pdecon.XComponent, SecondNumber="0")  # -> Equality, Inequality
equals_2 = Equality(FirstNumber=pdecon.ZComponent, SecondNumber="0")  # -> Equality, Inequality
item = ListItem(List=sort.Keys, Index=0, Wrap=True)
and = GateAnd(A=equals.Equality, B=equals_2.Equality)
equals_3 = Equality(FirstNumber=pdecon.ZComponent, SecondNumber=item)  # -> Equality, Inequality
cull = CullPattern(List=demesh.Vertices, CullPattern=and)
cull_2 = CullPattern(List=demesh.Vertices, CullPattern=equals_3.Equality)
σa = CreateAnalysisCase(Name="Static", Description="L1")

# ----
# Modal analysis seed file is defined with Modal dynamic analysis
# Download the seed file (Modal analysis) and enter its file path
panel_2 = Panel("C:\Temp\Modal analysis (Seed file).gwb")
open_model = OpenModel(FilenameAndPath=panel_2)

support = CreateSupport(Point=[cull, cull_2], Plane=PlaneXY(0, 0, 0), x=True, xx=True, y=True, yy=True, z=True, zz=True)
create_analysis_task = CreateAnalysisTask(
    TaskID="2",
    Name="Footfall",
    ModalAnalysisTask="1",
    ResponseNodes="All",
    ExcitationNodes="All",
    NumberOfFootfalls="100",
    Walker="0.076",
    DirectionOfResponses="1",
    FrequencyWeightingCurve="3",
    ExcitationForcesDLFs="7",
    ConstantDamping="0.0199",
    casesParamIndex=9,
    Solver="Footfall",
    Method="Rigorous excitation")
σt = CreateAnalysisTask(TaskID="3", AnalysisCases=σa, casesParamIndex=2, Solver="Static")
gravityload = CreateGravityLoad(LoadCase=null, GravityFactor=Vector(0, 0, -1))
analyse = AnalyseModel(
    ModelSAndLists=[open_model, createlist],
    GSAGeometryIn_m=flatten([flatten, support]),
    Load=gravityload,
    AnalysisTasksCombinations=[create_analysis_task, σt],
    Analyse=True,
    ReMesh=True,
    Tolerance=0.001,
    Unit="m")  # -> Model, Errors, Warnings, Remarks, Log

save = SaveGSAModel(GSAModel=analyse.Model, Save=True, FileAndPath="C:\Temp\Staircase.gwb")

get_model_lists = GetModelLists(GSAModel=analyse.Model)
list_info = ListInfo(List=get_model_lists, Unit="mm")  # -> Index, Name, Type, Definition, ListObjectsIn_mm, ExpandList

# ----
# A1 - A100 : Model dynamic modes
# A101 - Footfall analysis
# A102 - Static analysis
selres = SelectResults(GSAModel=analyse.Model, Type="AnalysisCase", Case_ID="A101")

footfall_results = FootfallResults(Result=selres, NodeFilterList=list_info.Definition, Type="Resonant", Max_Min="Max Response Factor")  # -> MaximumResponseFactor, PeakVelocity_m_s, RMSVelocity_m_s, PeakAcceleration_m_s, RMSAcceleration_m_s, CriticalNode, CriticalFrequency_Hz, NodeIDs

# ----
# Turn on preview to see
# contours on Rhino
contour_node_results = ContourNodeResults(
    Result=selres,
    Scalar=10,
    Display=0,
    Mode=2,
    envelope="Absolute",
    force="kN",
    legend=True,
    legendHeight=110,
    legendScale=1,
    legendWidth=120,
    length="mm",
    moment="kN·m",
    noDec=0,
    Result_Type="Footfall",
    Component="Resonant",
    slider=False,
    val=0,
    valMax=1000,
    valMin=0)  # -> ResultPoint, Colours, Values_mm

panel_3 = Panel([footfall_results.MaximumResponseFactor, footfall_results.PeakVelocity_m_s, footfall_results.RMSVelocity_m_s, footfall_results.PeakAcceleration_m_s, footfall_results.RMSAcceleration_m_s, footfall_results.CriticalNode, footfall_results.CriticalFrequency_Hz, footfall_results.NodeIDs])
