# Grasshopper definition Various modes.gh (Grasshopper 1.0.7)
# Copyright: Arup
# plug-ins: GSA

# ----
# Inputs
column_height_m = Slider(2.75, range=0..10)
no_of_bays_x = Slider(5, range=0..10)
bay_width_x_m = Slider(4.64, range=0..10)
no_of_bays_y = Slider(5, range=0..10)
bay_width_y_m = Slider(6, range=0..10)

# ----
# Download the seed file (Analysis tasks) and enter its location path
# 
# The Analysis tasks seed file has model stability, modal buckling
# and modal dynamic tasks defined, respectively
# Each task is set to calculate 5 modes
panel = Panel("C:\Temp\Analysis tasks.gwb")
open = OpenModel(FilenameAndPath=panel)

# ---- group: Materials from seed file
getmats = GetModelMaterials(GSAModel=open)  # -> Steel, Concrete, PMat, Aluminium, Timber, Glass, Fabric, Custom

# ----
profile = CreateProfile(
    catalogueIndex=2,
    inclSS=False,
    lengthUnit="Millimeter",
    mode="Catalogue",
    Profile_type="Catalogue",
    Catalogue="British",
    Type="Universal columns(UC) - EN10365:2017",
    Profile="BSI-UC UC305x305x198",
    typeIndex=256)
profile_2 = CreateProfile(
    catalogueIndex=2,
    inclSS=False,
    lengthUnit="Millimeter",
    mode="Catalogue",
    Profile_type="Catalogue",
    Catalogue="British",
    Type="Universal beams(UB) - EN10365:2017",
    Profile="BSI-UB UB254x146x37",
    typeIndex=255)
pt = ConstructPoint(XCoordinate=0, YCoordinate=0, ZCoordinate=0)
section = CreateSection(Profile=profile, Material=getmats.Steel, Basic_Offset="Centroid")
section_2 = CreateSection(Profile=profile_2, Material=getmats.Steel, Basic_Offset="Centroid")
line = LineSDL(Start=pt, Direction=Vector(0, 0, 1), Length=column_height_m)
support = CreateSupport(Point=pt, Plane=PlaneXY(0, 0, 0), x=True, xx=False, y=True, yy=False, z=True, zz=False)  # -> flatten(Node)
mem1d = Create1DMember(
    Curve=line,
    Property=section,
    Preview3dSection=False,
    x1=False,
    x2=False,
    xx1=False,
    xx2=False,
    y1=False,
    y2=False,
    yy1=False,
    yy2=False,
    z1=False,
    z2=False,
    zz1=False,
    zz2=False)
X = UnitX(Factor=bay_width_x_m)
Y = UnitY(Factor=bay_width_y_m)
arrlinear = LinearArray(Geometry=support, Direction=X, Count=no_of_bays_x)  # -> Geometry, Transform
arrlinear_2 = LinearArray(Geometry=mem1d, Direction=X, Count=no_of_bays_x)  # -> Geometry, Transform
end = EndPoints(Curve=arrlinear_2.Geometry)  # -> Start, End
pline = PolyLine(Vertices=end.End, Closed=False)
explode = Explode(Curve=pline, Recursive=True)  # -> Segments, Vertices

# ---- group: Supports
arrlinear_3 = LinearArray(Geometry=arrlinear.Geometry, Direction=Y, Count=no_of_bays_y)  # -> flatten(Geometry), Transform

# ---- group: Columns
arrlinear_4 = LinearArray(Geometry=arrlinear_2.Geometry, Direction=Y, Count=no_of_bays_y)  # -> Geometry, Transform

# ----
mem1d_2 = Create1DMember(
    Curve=explode.Segments,
    Property=section_2,
    Preview3dSection=False,
    x1=False,
    x2=False,
    xx1=False,
    xx2=False,
    y1=False,
    y2=False,
    yy1=False,
    yy2=False,
    z1=False,
    z2=False,
    zz1=False,
    zz2=False)
end_2 = EndPoints(Curve=arrlinear_4.Geometry)  # -> Start, End
number_slider = Slider(0, range=0..100)
arrlinear_5 = LinearArray(Geometry=mem1d_2, Direction=Y, Count=no_of_bays_y)  # -> flatten(Geometry), Transform
pline_2 = PolyLine(Vertices=end_2.End, Closed=False)
explode_2 = Explode(Curve=pline_2, Recursive=True)  # -> Segments, Vertices

# ----
# 1. Create Bool 6
# Release yy and zz to see model stability
# analysis pointing out the problem node.
b6 = CreateBool6(x=False, xx=False, y=False, yy=False, z=False, zz=False)

cull_i = CullIndex(List=arrlinear_5.Geometry, Indices=number_slider, Wrap=True)
mem1d_3 = Create1DMember(
    Curve=explode_2.Segments,
    Property=section_2,
    Preview3dSection=False,
    x1=False,
    x2=False,
    xx1=False,
    xx2=False,
    y1=False,
    y2=False,
    yy1=False,
    yy2=False,
    z1=False,
    z2=False,
    zz1=False,
    zz2=False)
item = ListItem(List=arrlinear_5.Geometry, Index=number_slider, Wrap=True)
number_slider_2 = Slider(0, range=0..100)
cull_i_2 = CullIndex(List=mem1d_3, Indices=number_slider_2, Wrap=True)
item_2 = ListItem(List=mem1d_3, Index=number_slider_2, Wrap=True)
mem1dedit = Edit1DMember(Member1D=item_2, StartRelease=b6, EndRelease=b6, Preview3dSection=False)  # -> Member1D, Member1dNumber, Curve, Property, MemberGroup, MemberType, _1DElementType, Offset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
mem1dedit_2 = Edit1DMember(Member1D=item, StartRelease=b6, EndRelease=b6, Preview3dSection=False)  # -> Member1D, Member1dNumber, Curve, Property, MemberGroup, MemberType, _1DElementType, Offset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

# ----
# 2. Ill-conditioning:
# Follow the step in the '1.Create Bool 6' component
# group and note the below mentioned behaviour
# 
# The component turns red and throws an error stating
# that Task 2 failed due to ill-conditioning when
# excessive releases are applied (expected).
# Modal stability analysis (Task 1) and Modal dynamic
# analysis (Task 3) continues to run.
# 
# Task 1 highlights the issue caused by excessive releases.
analyse = AnalyseModel(
    ModelS=open,
    GSAGeometryIn_m=flatten([arrlinear_4.Geometry, arrlinear_3.Geometry, cull_i_2, cull_i, mem1dedit.Member1D, mem1dedit_2.Member1D]),
    Analyse=True,
    ReMesh=True,
    Tolerance=0.001,
    Geometry_Unit="Meter")  # -> Model, Errors, Warnings, Remarks, Log

save = SaveGSAModel(GSAModel=analyse.Model, Save=True, FileAndPath="C:\Temp\Various modes.gwb")

# ----
# Model stability modes  : Task 1 (A1 - A5)
# Modal buckling modes : Task 2 (A6 - A10)
# Modal dynamic modes : Task 3 (A11 - A15)
selres = SelectResults(GSAModel=analyse.Model, Type="AnalysisCase", Case_ID="A6")

nodecontour = ContourNodeResults(
    Result=selres,
    Scalar=10,
    Display=7,
    Mode=0,
    envelope="Absolute",
    force="kN",
    legend=True,
    legendHeight=110,
    legendScale=1,
    legendWidth=120,
    length="m",
    moment="kN·m",
    noDec=0,
    Result_Type="Displacement",
    Component="Resolved |R|",
    slider=True,
    val=0,
    valMax=1000,
    valMin=0)  # -> P, Colours, Values_rad
contour1d = Contour1DResults(
    Result=selres,
    IntermediatePoints=10,
    Scale=10,
    Display=3,
    Mode=0,
    energy="MJ",
    envelope="Absolute",
    force="kN",
    legend=True,
    legendHeight=110,
    legendScale=1,
    legendWidth=120,
    length="mm",
    moment="kN·m",
    noDec=0,
    Result_Type="Displacement",
    Component="Resolved |U|",
    slider=True,
    stress="MPa",
    val=0,
    valMax=1000,
    valMin=0)  # -> L, Colours, Values_mm
globalperformance = GlobalPerformanceResults(Result=selres, Mass_Unit="t", Inertia_Unit="m⁴", Stiffness_Unit="kN/m")  # -> EffectiveMassX_t, EffectiveMassY_t, EffectiveMassZ_t, EffectiveInertiaX_m⁴, EffectiveInertiaY_m⁴, EffectiveInertiaZ_m⁴, Mode, ModalMass_t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

# ----
# Dynamic mode frequency will be displayed for
# Anaysis Tasks A11 - A15
vibration_mode_frequency_modal_dynamic = Panel(globalperformance.Frequency_Hz)

# ----
# Buckling mode load factor will be displayed for
# Anaysis Tasks A6 - A10
buckling_mode_modal_buckling = Panel(globalperformance.LoadFactor)

# ----
# When this value is zero or numerical zero, the
# structure has insufficient supports, too many
# releases etc. See the deflected shape and
# node displacements and rotations to pin point
# the problem. Analysis Task A1 - A5
model_stability_eigenvalue = Panel(globalperformance.Eigenvalue)
