# Grasshopper definition 2_Footfall.gh (Grasshopper 1.0.8)
# plug-ins: GSA

# ----
# Modal analysis [seed file]
# Download and open the Modal_Task[seed_file] from
# https://samples.oasys-software.com/gsa/10.2/Gsa_GH/
# Webinar_Scripts/Innovative_Engineering_for_Repetitive_Structures
panel = Panel("C:\Temp\Modal_Task[seed_file].gwb")
open = OpenModel(FilenameAndPath=panel)

# ----
# Global model [seed file]
# Download and open the Global_Model[seed_file] from
# https://samples.oasys-software.com/gsa/10.2/Gsa_GH/
# Webinar_Scripts/Innovative_Engineering_for_Repetitive_Structures
panel_2 = Panel("C:\Temp\Global_Model[seed_file].gwb")
open_2 = OpenModel(FilenameAndPath=panel_2)
getgeo = GetModelGeometry(GSAModel=open_2, Mode=1, UseTasks=False, Unit="m")  # -> NodesIn_m, _1DElementsIn_m, _2DElementsIn_m, _3DElementsIn_m, _1DMembersIn_m, _2DMembersIn_m, _3DMembersIn_m, Assemblies

# ----
# 1D Members
panel_3 = Panel("FL columns")
getgeo_2 = GetModelGeometry(GSAModel=open_2, MemberFilterList=panel_3, Mode=1, Unit="m")  # -> NodesIn_m, _1DElementsIn_m, _2DElementsIn_m, _3DElementsIn_m, _1DMembersIn_m, _2DMembersIn_m, _3DMembersIn_m, Assemblies
getgeo_3 = GetModelGeometry(GSAModel=open_2, MemberFilterList="Beams", Mode=1, Unit="m")  # -> NodesIn_m, _1DElementsIn_m, _2DElementsIn_m, _3DElementsIn_m, _1DMembersIn_m, _2DMembersIn_m, _3DMembersIn_m, Assemblies
getgeo_4 = GetModelGeometry(GSAModel=open_2, MemberFilterList="GL columns", Mode=1, Unit="m")  # -> NodesIn_m, _1DElementsIn_m, _2DElementsIn_m, _3DElementsIn_m, _1DMembersIn_m, _2DMembersIn_m, _3DMembersIn_m, Assemblies
m1d = Member1D([getgeo_3._1DMembersIn_m, getgeo_4._1DMembersIn_m, getgeo_2._1DMembersIn_m])

# ----
# Footfall analysis task
panel_4 = Panel("Footfall")
σt = CreateAnalysisTask(
    TaskID="2",
    Name=panel_4,
    ModalAnalysisTask="1",
    ResponseNodes="All",
    NumberOfFootfalls="100",
    Walker="76",
    DirectionOfResponses="1",
    FrequencyWeightingCurve="3",
    ExcitationForcesDLFs="3",
    ConstantDamping="0.0199",
    casesParamIndex=8,
    Solver="Footfall",
    Method="Self excitation")

# ----
# Loads
panel_5 = Panel("1")
getloads = GetModelLoads(GSAModel=open_2, Unit="mm")  # -> LoadCases, GravityLoads, NodeLoads, BeamLoads, FaceLoads, GridPointLoads_mm, GridLineLoads_mm, GridAreaLoads_mm, GridPlaneSurfaces_mm
gravityload = CreateGravityLoad(LoadCase=panel_5, GravityFactor=Vector(0, 0, -1))

# ----
# 2D Members
getgeo_5 = GetModelGeometry(GSAModel=open_2, Mode=1, Unit="m")  # -> NodesIn_m, _1DElementsIn_m, _2DElementsIn_m, _3DElementsIn_m, _1DMembersIn_m, _2DMembersIn_m, _3DMembersIn_m, Assemblies
item = ListItem(List=getgeo_5._2DMembersIn_m, Index=Slider(0, range=0..2), Wrap=True)
editpa = Edit2DProperty(Property2D=item, Thickness_mm=Slider(200, range=100..300), LengthUnit="Millimeter", ReferenceEdge=0, SupportType=0)  # -> Property2D, Prop2dID, Name, Colour, Axis, Type, Material, Thickness_mm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
mesh_size = Slider(0.5, range=0.5..1.5)

# ----
# Supports
elemfrommem = ElementsFromMembers(_2DMembers_mm=item, Tolerance=0.001, Unit="Meter")  # -> Nodes, _1DElements, _2DElements, _3DElements, GSAModel
mesh = Mesh(elemfrommem._2DElements)
demesh = DeconstructMesh(Mesh=mesh)  # -> Vertices, Faces, Colours, Normals
crv = Curve(item)
incurve = PointInCurve(Point=demesh.Vertices, Curve=crv)  # -> Relationship, Point
equals = Equality(FirstNumber=incurve.Relationship, SecondNumber=1)  # -> Equality, Inequality
end = EndPoints(Curve=getgeo_4._1DMembersIn_m)  # -> Start, End
end_2 = EndPoints(Curve=getgeo_2._1DMembersIn_m)  # -> Start, End
cull = CullPattern(List=demesh.Vertices, CullPattern=equals.Equality)
support = CreateSupport(Point=cull, Plane=PlaneXY(0, 0, 0), x=True, xx=False, y=True, yy=False, z=True, zz=False)
support_2 = CreateSupport(Point=[end.Start, end_2.End], Plane=PlaneXY(0, 0, 0), x=True, xx=True, y=True, yy=True, z=True, zz=True)

mem2dedit = Edit2DMember(Member2D=item, InclPoints=support, _2DProperty=editpa.Property2D, MeshSizeInModelUnits=mesh_size, Preview3dSection=False)  # -> Member2D, MemberNumber, Brep, InclPoints, InclCurves, _2DProperty, MemberGroup, MemberType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

analyse = AnalyseModel(
    ModelS=open,
    GSAGeometryIn_m=flatten([support_2, support, m1d, mem2dedit.Member2D]),
    Loads=flatten([gravityload, getloads.GridAreaLoads_mm]),
    AnalysisTasksCombinations=σt,
    Analyse=True,
    ReMesh=True,
    Tolerance=0.001,
    Geometry_Unit="Meter")  # -> flatten(Model), Errors, Warnings, Remarks, Log

# ----
# Modal dynamic results
panel_6 = Panel("""1
2
3
4
5
6
7
8
9
10""")
selres = SelectResults(GSAModel=analyse.Model, Case=panel_6, Type="AnalysisCase", Case_ID="A10")
selres_2 = SelectResults(GSAModel=analyse.Model, Type="AnalysisCase", Case_ID="A1")
globalperformance = GlobalPerformanceResults(Result=selres, Mass_Unit="t", Inertia_Unit="m⁴", Stiffness_Unit="kN/m")  # -> EffectiveMassX_t, EffectiveMassY_t, EffectiveMassZ_t, EffectiveInertiaX_m⁴, EffectiveInertiaY_m⁴, EffectiveInertiaZ_m⁴, Mode, ModalMass_t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
contour2d = Contour2DResults(
    Result=selres_2,
    Display=2,
    Mode=0,
    envelope="Absolute",
    flayer=0,
    force="kN/m",
    legend=True,
    legendScale=3,
    length="m",
    model="mm",
    moment="kN",
    noDec=0,
    Result_Type="Displacement",
    Component="Translation Uz",
    slider=True,
    stress="MPa",
    val=2,
    valMax=1000,
    valMin=0)  # -> M, Colours, Values_m
modal_frequency = Panel(globalperformance.Frequency_Hz)
contour1d = Contour1DResults(
    Result=selres_2,
    IntermediatePoints=10,
    Scale=10,
    Display=3,
    Mode=0,
    energy="MJ",
    envelope="Absolute",
    force="kN",
    legend=False,
    legendScale=1,
    length="mm",
    moment="kN·m",
    noDec=0,
    Result_Type="Displacement",
    Component="Resolved |U|",
    slider=True,
    stress="MPa",
    val=0,
    valMax=1000,
    valMin=0)  # -> L, Colours, Values_mm

save = SaveGSAModel(GSAModel=analyse.Model, Save=True, FileAndPath="C:\Temp\Footfall.gwb")

# ----
# Footfall results
selres_3 = SelectResults(GSAModel=analyse.Model, Type="AnalysisCase", Case_ID="A16")
contourelem1d = _1DContourResults(
    Result=selres_3,
    ElementFilterList="All",
    IntermediatePoints=10,
    Scale=10,
    Display=0,
    Mode=3,
    energy="MJ",
    envelope="Absolute",
    force="kN",
    legend=False,
    legendScale=1,
    length="mm",
    moment="kN·m",
    noDec=0,
    Result_Type="Footfall",
    Component="Resonant",
    slider=False,
    stress="MPa",
    val=0,
    valMax=1000,
    valMin=0)  # -> L, Colours, LegendValues_
contourelem2d = _2DContourResults(
    Result=selres_3,
    ElementFilterList="All",
    Display=0,
    Mode=3,
    envelope="Absolute",
    flayer=0,
    force="kN/m",
    legend=True,
    legendScale=3,
    length="mm",
    model="m",
    moment="kN",
    noDec=0,
    Result_Type="Footfall",
    Component="Resonant",
    slider=False,
    stress="MPa",
    val=0,
    valMax=1000,
    valMin=0)  # -> M, Colours, LegendValues_
footfall = FootfallResults(Result=selres_3, Type="Transient", Max_Min="Max Response Factor")  # -> MaximumResponseFactor, PeakVelocity_m_s, RMSVelocity_m_s, PeakAcceleration_m_s, RMSAcceleration_m_s, CriticalNode, CriticalFrequency_Hz, NodesIDs
footfall_2 = FootfallResults(Result=selres_3, Type="Resonant", Max_Min="Max Response Factor")  # -> MaximumResponseFactor, PeakVelocity_m_s, RMSVelocity_m_s, PeakAcceleration_m_s, RMSAcceleration_m_s, CriticalNode, CriticalFrequency_Hz, NodesIDs
max_resonant_response_factor = Panel([footfall_2.MaximumResponseFactor, footfall_2.PeakVelocity_m_s, footfall_2.RMSVelocity_m_s, footfall_2.PeakAcceleration_m_s, footfall_2.RMSAcceleration_m_s, footfall_2.CriticalNode, footfall_2.CriticalFrequency_Hz, footfall_2.NodesIDs])
max_transient_response_factor = Panel([footfall.MaximumResponseFactor, footfall.PeakVelocity_m_s, footfall.RMSVelocity_m_s, footfall.PeakAcceleration_m_s, footfall.RMSAcceleration_m_s, footfall.CriticalNode, footfall.CriticalFrequency_Hz, footfall.NodesIDs])

# ----
# Outputs in Rhino
# Turn Preview to view
# outputs on Rhino
number_slider = Slider(4, range=0..10)
pt = ConstructPoint(XCoordinate=Slider(0, range=0..110), YCoordinate=Slider(12, range=0..110), ZCoordinate=Slider(2, range=0..10))
split = SplitList(List=modal_frequency, Index=Slider(1, range=0..10))  # -> ListA, ListB
series = Series(Start=pt, Step=1, Count=number_slider)
Z = UnitZ(Factor=series)
move = Move(Geometry=pt, Motion=Z)  # -> Geometry, Transform
panel_7 = Panel("""Slab thickness : 
Max Transient RF : 
Max Resonant RF : """)
merge = Merge(Data2=max_transient_response_factor, Data3=max_resonant_response_factor)  # -> flatten(Result)
rev = ReverseList(List=move.Geometry)
panel_8 = Panel(merge)
align = AlignPlanes(Planes=rev)
concat = Concatenate(FragmentA=panel_7, FragmentB=merge)
concat_2 = Concatenate(FragmentA="Frequency : ", FragmentB=split.ListA)
tag = TextTag(Location=align, Text=flatten([concat_2, concat]), Colour=ColourSwatch(SwatchColor=RGB(0, 0, 0)))
panel_9 = Panel("""Max Response Factor:
Peak velocity : 
RMS velocity : 
Peak acceleration : 
RMS Acceleration : 
Critical node : 
Critical frequency : 
Node ID :""")
panel_10 = Panel("""Max Response Factor:
Peak velocity : 
RMS velocity : 
Peak acceleration : 
RMS Acceleration : 
Critical node : 
Critical frequency : 
Node ID :""")
concat_3 = Concatenate(FragmentA=panel_9, FragmentB=max_transient_response_factor)
concat_4 = Concatenate(FragmentA=panel_10, FragmentB=max_resonant_response_factor)

panel_11 = Panel(concat_4)
panel_12 = Panel(concat_3)
