# Grasshopper definition GSA-to-Revit Model Export.gh (Grasshopper 1.0.8)
# Copyright: Arup
# plug-ins: Rhino.Inside for Autodesk Revit, GSA, HFTidyCanvas
# This script is used for ...

# ----
# Download and open the 'Multi-Storey Core Wall Building
# with Dome Structure.gwb' GSA model file
panel = Panel("C:\Temp\Multi-Storey Core Wall Building with Dome Structure.gwb")
open = OpenModel(FilenameAndPath=panel)

model = DataDescription(open)
getgeo = GetModelGeometry(GSAModel=model, Mode=0, Unit="mm")  # -> NodesIn_mm, _1DElementsIn_mm, _2DElementsIn_mm, _3DElementsIn_mm, _1DMembersIn_mm, _2DMembersIn_mm, _3DMembersIn_mm, Assemblies
getprops = GetModelProperties(GSAModel=model)  # -> Sections, _2DProperties, _3DProperties, SpringProperties

# ---- group: Identifying Vertical, Horizontal and Inclined 1D Members
_1d_members_in_m = DataDescription(getgeo._1DMembersIn_mm)
crv = Curve(_1d_members_in_m)
series = Series(Start=0, Step=1, Count=10)  # -> flatten(Series)
item = ListItem(List=crv, Index=series, Wrap=True)
run_all = BooleanToggle(True)
filter = StreamFilter(Gate=run_all, Stream0=item, Stream1=crv)
geometry = DataDescription(filter)
devec = DeconstructVector(Vector=geometry)  # -> XComponent, YComponent, ZComponent
abs = Absolute(Value=devec.ZComponent)
similar = Similarity(FirstNumber=abs, SecondNumber="1", Threshold="0.01")  # -> Similarity, AbsoluteDifference
dispatch = Dispatch(List=geometry, DispatchPattern=similar.Similarity)  # -> ListA, ListB
devec_2 = DeconstructVector(Vector=dispatch.ListB)  # -> XComponent, YComponent, ZComponent
similar_2 = Similarity(FirstNumber=devec_2.ZComponent, SecondNumber="0", Threshold="0.01")  # -> Similarity, AbsoluteDifference
dispatch_2 = Dispatch(List=dispatch.ListB, DispatchPattern=similar_2.Similarity)  # -> ListA, ListB
clean = CleanTree(RemoveNulls=True, RemoveInvalid=True, RemoveEmpty=Toggle(True), Tree=dispatch.ListA)
clean_2 = CleanTree(RemoveNulls=True, RemoveInvalid=True, RemoveEmpty=Toggle(True), Tree=dispatch_2.ListA)
clean_3 = CleanTree(RemoveNulls=True, RemoveInvalid=True, RemoveEmpty=Toggle(True), Tree=dispatch_2.ListB)

# ---- group: Identifying Horizontal and Vertical 2D Members
_2d_members_in_m = DataDescription(getgeo._2DMembersIn_mm)
mem2dedit = Edit2DMember(Member2D=_2d_members_in_m, _2DProperty=getprops._2DProperties, Preview3dSection=False)  # -> Member2D, MemberNumber, Brep, InclPoints, InclCurves, _2DProperty, MemberGroup, MemberType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
area = Area(Geometry=mem2dedit.Brep)  # -> Area, Centroid
srf_cp = SurfaceClosestPoint(Point=area.Centroid, Surface=mem2dedit.Brep)  # -> Point, UVPoint, Distance
evalsrf = EvaluateSurface(Surface=mem2dedit.Brep, Point=srf_cp.UVPoint)  # -> Point, Normal, UDirection, VDirection, Frame
devec_3 = DeconstructVector(Vector=evalsrf.Normal)  # -> XComponent, YComponent, ZComponent
similar_3 = Similarity(FirstNumber=devec_3.ZComponent, SecondNumber="0", Threshold=0.1)  # -> Similarity, AbsoluteDifference
dispatch_3 = Dispatch(List=mem2dedit.Brep, DispatchPattern=similar_3.Similarity)  # -> ListA, ListB

# ---- group: 1D Sections
editpb = EditSection(Section=getprops.Sections)  # -> Section, SectionNumber, SectionProfile, Material, BasicOffset, AddOffsetY_cm, AddOffsetZ_cm, SectionModifier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
py3 = Python3Script(x=editpb.SectionProfile)  # -> out
# ---------- py3: Python ----------
import rhinoscriptsyntax as rs
import re

# List of records
records = [x]

# Patterns for different types
patterns = [
    r'UB \d+x\d+x\d+',
    r'UC \d+x\d+x\d+',
    r'RHS\d+x\d+x\d* ',
    r'STD R \d+ \d+',
    r'EA \d+x\d+x\d+'
]

# Extract and print all matching terms
for record in records:
    for pattern in patterns:
        match = re.search(pattern, record)
        if match:
            result = match.group().replace(" ", "")

            # UC -> UKC
            if result.startswith("UC"):
                result = "UKC" + result[2:]

            # UB -> UKB
            elif result.startswith("UB"):
                result = "UKB" + result[2:]

            # RHS -> add " #" at the end
            elif result.startswith("RHS"):
                result = result + " #"

            print(result)
# ---------- end py3 ----------
explode_tree = ExplodeTree(Data=py3)  # -> Branch0, Branch1, Branch2

# ---- group: Shear walls
branch = TreeBranch(Tree=dispatch_3.ListA, Path="{0;1}", MaintainPaths=True)
edges = BrepEdges(Brep=branch)  # -> Naked, Interior, NonManifold
types = QueryTypes(Kind=3, FamilyName="Basic Wall", TypeName="STR-Conc Insitu Wall Nwt - (300mm)")
join = JoinCurves(Curves=edges.Naked, Preserve=False)
p_wall = AddWallProfile(Profile=join, Type=types, TrackingMode=1)

# ---- group: Facades
branch_2 = TreeBranch(Tree=dispatch_3.ListA, Path="{0;0}", MaintainPaths=True)
edges_2 = BrepEdges(Brep=branch_2)  # -> Naked, Interior, NonManifold
types_2 = QueryTypes(Kind=3, FamilyName="Curtain Wall", TypeName="Curtain Wall")
join_2 = JoinCurves(Curves=edges_2.Naked, Preserve=False)
p_wall_2 = AddWallProfile(Profile=join_2, Type=types_2, TrackingMode=1)

# ---- group: Columns
# Model Export to Revit
panel_2 = Panel("STR_UKC-UK Columns-Column")
types_3 = QueryTypes(Kind=3, FamilyName=panel_2, TypeName=explode_tree.Branch0)  # -> flatten(Types)
column = DataDescription(clean)
s_column = AddStructuralColumn(Curve=column, Type=types_3, TrackingMode=1)

# ---- group: Beams
types_4 = QueryTypes(Kind=3, FamilyName="STR_UKB-UK Beams", TypeName=explode_tree.Branch1)  # -> flatten(Types)
beam = DataDescription(clean_2)
s_beam = AddStructuralBeam(Curve=beam, Type=types_4, TrackingMode=1)

# ---- group: Dome beams
types_5 = QueryTypes(Kind=3, FamilyName="STR_RHS", TypeName=explode_tree.Branch2)  # -> flatten(Types)
inclined = DataDescription(clean_3)
s_brace = AddStructuralBrace(Curve=inclined, Type=types_5, TrackingMode=1)
