# Grasshopper definition Steel Design.gh (Grasshopper 1.0.8)
# Copyright: Arup
# plug-ins: GSA

# ----
# Inputs [m]
bay_width_y = Slider(5.3, range=0..10)
bay_width_x = Slider(4, range=0..10)
no_of_columns_x = Slider(5, range=0..10)
no_of_columns_y = Slider(5, range=0..10)
storey_height = Slider(4, range=0..10)
no_of_stories = Slider(3, range=0..10)
# Inputs [m]
# Create GSA members
# Geometry
point = Point(Point(0, 0, 0))

# ----
# Inputs display
panel = Panel("""Storey height [m]: 
No. of stories [no.]: 
Bay width, x_dir, [m]: 
Bay width, y_dir, [m]: 
No. of columns, x_dir, [no.]: 
No. of columns, y_dir, [no.]: """)
pt = ConstructPoint(XCoordinate=Slider(0, range=0..10), YCoordinate=Slider(10, range=0..10), ZCoordinate=Slider(10, range=0..10))
concat = Concatenate(FragmentA=panel, FragmentB=[storey_height, no_of_stories, bay_width_x, bay_width_y, no_of_columns_x, no_of_columns_y])
series = Series(Start=pt, Step=1, Count=7)
Z = UnitZ(Factor=series)
merge = Merge(Data1="Inputs:", Data2=concat)
move = Move(Geometry=pt, Motion=Z)  # -> Geometry, Transform
rev = ReverseList(List=move.Geometry)
tag = TextTag(Location=rev, Text=merge)

# ----
# Results
# Section designer
# Add loads
# Analysis
# Define tasks and cases
# Geometry
cluster = Cluster(
    geometry=point,
    factor=bay_width_x,
    count=no_of_columns_x,
    factor_2=bay_width_y,
    count_2=no_of_columns_y,
    factor_3=storey_height,
    count_3=no_of_stories,
    A=bay_width_y,
    start_2=no_of_columns_y,
    step_2=no_of_columns_y,
    count_5=no_of_stories,
    A_5=bay_width_x,
    A_2=no_of_columns_x,
    A_3=no_of_columns_y,
    A_4=bay_width_y,
    start=storey_height,
    step=storey_height,
    count_4=no_of_stories)  # -> unit_vector, point_2, segments_3, segments, segments_2, segments_4, surfaces, unit_vector_2

# ----
# Converting Geometry to GSA members
create_material = CreateMaterial(Material_type="Steel", Design_Code="EN 1993-1-1:2005", Grade="S355")

# ----
# Columns
create_profile = CreateProfile(
    catalogueIndex=2,
    inclSS=False,
    lengthUnit="Millimeter",
    mode="Catalogue",
    Profile_type="Catalogue",
    Catalogue="British",
    Type="Universal columns(UC) - EN10365:2017",
    Profile="BSI-UC UC203x203x46",
    typeIndex=256)
create_section = CreateSection(Profile=create_profile, Material=create_material, Basic_Offset="Centroid")
create_steel_section_pool = CreateSteelSectionPool(SectionPoolID="1", Section=create_section)
create_1d_member = Create1DMember(
    Curve=flatten(cluster.segments_3),
    Property=create_steel_section_pool,
    Preview3dSection=False,
    x1=False,
    x2=False,
    xx1=False,
    xx2=False,
    y1=False,
    y2=False,
    yy1=False,
    yy2=False,
    z1=False,
    z2=False,
    zz1=False,
    zz2=False)

# ----
# Beams
# Material
create_profile_2 = CreateProfile(
    catalogueIndex=2,
    inclSS=False,
    lengthUnit="Millimeter",
    mode="Catalogue",
    Profile_type="Catalogue",
    Catalogue="British",
    Type="Universal beams(UB) - EN10365:2017",
    Profile="BSI-UB UB406x140x39",
    typeIndex=255)
create_section_2 = CreateSection(Profile=create_profile_2, Material=create_material, Basic_Offset="Centroid")
create_steel_section_pool_2 = CreateSteelSectionPool(SectionPoolID="2", Section=create_section_2)
create_1d_member_2 = Create1DMember(
    Curve=flatten([cluster.segments, cluster.segments_2]),
    Property=create_steel_section_pool_2,
    Preview3dSection=False,
    x1=False,
    x2=False,
    xx1=False,
    xx2=False,
    y1=False,
    y2=False,
    yy1=False,
    yy2=False,
    z1=False,
    z2=False,
    zz1=False,
    zz2=False)

# ----
# Secondary Beams
create_profile_3 = CreateProfile(
    catalogueIndex=2,
    inclSS=False,
    lengthUnit="Millimeter",
    mode="Catalogue",
    Profile_type="Catalogue",
    Catalogue="British",
    Type="Universal beams(UB) - EN10365:2017",
    Profile="BSI-UB UB356x171x57",
    typeIndex=255)
create_section_3 = CreateSection(Profile=create_profile_3, Material=create_material, Basic_Offset="Centroid")
create_steel_section_pool_3 = CreateSteelSectionPool(SectionPoolID="3", Section=create_section_3)
create_1d_member_3 = Create1DMember(
    Curve=flatten(cluster.segments_4),
    Property=create_steel_section_pool_3,
    Preview3dSection=False,
    x1=False,
    x2=False,
    xx1=False,
    xx2=False,
    y1=False,
    y2=False,
    yy1=False,
    yy2=False,
    z1=False,
    z2=False,
    zz1=False,
    zz2=False)

# ----
# Concrete slab
number_slider = Slider(200, range=0..1000)
create_material_2 = CreateMaterial(Material_type="Concrete", Design_Code="EC2-1-1", Grade="C35/45")
create_2d_property = Create2DProperty(Thickness_mm=number_slider, Material=create_material_2, Type="Shell", Unit="mm")
create_2d_member = Create2DMember(
    Brep=cluster.surfaces,
    Property2D=create_2d_property,
    InternalOffset=invert(True),
    Preview3dSection=False,
    Mesh_mode="Quad dominant")

# ----
# Visualisation
# Supports
create_support = CreateSupport(Point=cluster.point_2, Plane=PlaneXY(0, 0, 0), x=True, xx=True, y=True, yy=True, z=True, zz=True)

item = ListItem(List=create_1d_member, Index=0, Wrap=True)
item_2 = ListItem(List=create_1d_member_2, Index=0, Wrap=True)
item_3 = ListItem(List=create_1d_member_3, Index=100, Wrap=True)
annotate_detailed = AnnotateDetailed(
    ElementMember=[item, item_2, item_3],
    Size=0.5,
    id=False,
    material=False,
    name=False,
    property=True,
    Type="Regular Dot",
    text3d=False)  # -> Annotations, Position, Text

# ----
# Inputs
loads_at_start = Slider(-5, range=-10..0)
loads_at_end = Slider(-5, range=-10..0)

# ----
# Inputs
loads = Slider(-101.16, range=-110..100)

# ----
# Inputs
rect_scale = Slider(0.5, range=0..1)
breadth = Slider(1, range=0..10)
width = Slider(2.5, range=0..10)
loads_2 = Slider(-10, range=-10..0)

# ----
# Inputs
loads_3 = Slider(10, range=-10..10)

value_list = ValueList({"x", "y", "z"}, selected="z")
value_list_2 = ValueList({"x", "y", "z"}, selected="z")

# ----
# Self-weight /Gravity load
panel_2 = Panel("1")
create_gravity_load = CreateGravityLoad(LoadCase=panel_2, GravityFactor=Vector(0, 0, -1))

# ----
# Dead load
panel_3 = Panel("2")
# Live load
panel_4 = Panel("3")
faceload = CreateFaceLoad(
    LoadCase=panel_4,
    Loadable2DObjects=create_2d_member,
    Axis=-1,
    Direction=value_list_2,
    Projected=False,
    Value_kN_m²="-5",
    Type="Uniform",
    Unit="kN/m²")
faceload_2 = CreateFaceLoad(
    LoadCase=panel_3,
    Loadable2DObjects=create_2d_member,
    Axis=-1,
    Direction=value_list,
    Projected=False,
    Value_kN_m²="-3.5",
    Type="Uniform",
    Unit="kN/m²")

# ----
# Analysis cases
panel_5 = Panel("""Selfweight
Dead load
Live load
Wind load
Grid area load
Grid line load
Grid point load""")
panel_6 = Panel("""L1
L2
L3
L4
L5
L6
L7""")
create_analysis_case = CreateAnalysisCase(Name=panel_5, Description=panel_6)

# ----
# Combination tasks
panel_7 = Panel("""1.35(A1+A2)+1.5A3
1.35(A1+A2)+0.9A4
1.35(A1+A2)+1.5A3+0.9A4
(C1 to C3)""")
panel_8 = Panel("""1
2
3
4""")
panel_9 = Panel("""1.35(SW+DL)+1.5LL
1.35(SW+DL)+0.9WL
1.35DL+1.5LL+0.9WL
Envelope(C1,C2,C3)""")
create_combination_case = CreateCombinationCase(ID=panel_8, Name=panel_9, Description=panel_7)

# ----
# Design task
panel_10 = Panel(" Task 1")
create_steel_design_task = CreateSteelDesignTask(
    Name=panel_10,
    Number=0,
    CombinationCase="4",
    TargetUtilisation="0.9",
    LowerLimit="0.5",
    GroupedDesign="True",
    Primary="Min Weight",
    Secondary="Min Depth")

# ----
# Analysis tasks and cases
σt = CreateAnalysisTask(Name="A1", AnalysisCases=create_analysis_case, casesParamIndex=2, Solver="Static")

# ----
# Defining effective lengths
create_member_end_restraint = CreateMemberEndRestraint(Shortcuts="Fixed")
create_member_end_restraint_2 = CreateMemberEndRestraint(Shortcuts="Fixed")
create_effective_length_options = CreateEffectiveLengthOptions(
    MemberRestraintStart=create_member_end_restraint,
    MemberRestraintEnd=create_member_end_restraint_2,
    DestabilisingLoadHeight=0,
    Options="Automatic",
    Load_position="Shear centre")
edit_1d_member = Edit1DMember(
    Member1D=flatten([create_1d_member_2, create_1d_member, create_1d_member_3]),
    SetEffectiveLengthOptions=create_effective_length_options,
    Preview3dSection=False)  # -> Member1D, Member1dNumber, Curve, Property, MemberGroup, MemberType, _1DElementType, Offset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

# ----
# Beam design -section pool
# Secondary beams
create_profile_4 = CreateProfile(
    catalogueIndex=2,
    inclSS=False,
    lengthUnit="Millimeter",
    mode="Catalogue",
    Profile_type="Catalogue",
    Catalogue="British",
    Type="Universal beams(UB) - EN10365:2017",
    Profile="All",
    typeIndex=255)
create_profile_5 = CreateProfile(
    catalogueIndex=2,
    inclSS=False,
    lengthUnit="Millimeter",
    mode="Catalogue",
    Profile_type="Catalogue",
    Catalogue="British",
    Type="Universal beams(UB) - EN10365:2017",
    Profile="All",
    typeIndex=255)
create_material_3 = CreateMaterial(Material_type="Steel", Design_Code="EN 1993-1-1:2005", Grade="S355")
create_material_4 = CreateMaterial(Material_type="Steel", Design_Code="EN 1993-1-1:2005", Grade="S355")
create_section_4 = CreateSection(Profile=create_profile_4, Material=create_material_4, Basic_Offset="Centroid")
create_section_5 = CreateSection(Profile=create_profile_5, Material=create_material_3, Basic_Offset="Centroid")
# Primary beams
create_steel_section_pool_4 = CreateSteelSectionPool(SectionPoolID="2", Section=create_section_4)
create_steel_section_pool_5 = CreateSteelSectionPool(SectionPoolID="3", Section=create_section_5)

# ----
# Column design -section pool
create_profile_6 = CreateProfile(
    catalogueIndex=2,
    inclSS=False,
    lengthUnit="Millimeter",
    mode="Catalogue",
    Profile_type="Catalogue",
    Catalogue="British",
    Type="Universal columns(UC) - EN10365:2017",
    Profile="All",
    typeIndex=256)
create_material_5 = CreateMaterial(Material_type="Steel", Design_Code="EN 1993-1-1:2005", Grade="S355")
create_section_6 = CreateSection(Profile=create_profile_6, Material=create_material_5, Basic_Offset="Centroid")
create_steel_section_pool_6 = CreateSteelSectionPool(SectionPoolID="1", Section=create_section_6)

series_2 = Series(Start="14", Step=1, Count="88")
series_3 = Series(Start=0, Step=1, Count=16)
item_4 = ListItem(List=create_profile_4, Index=series_2, Wrap=True)
item_5 = ListItem(List=create_profile_5, Index=series_3, Wrap=True)
cull = CullPattern(List=item_4, CullPattern=[True, True, False, False])

# ----
# Outputs display
number_slider_2 = Slider(48, range=0..110)
pt_2 = ConstructPoint(XCoordinate=Slider(10, range=0..110), YCoordinate=number_slider_2, ZCoordinate=Slider(-38, range=-50..11))
series_4 = Series(Start=pt_2, Step=1, Count=Slider(7, range=1..10))
panel_11 = Panel("""Before Steel design
Max Utilisation: 
Max Deformation: 

After Steel design
Max Utilisation: 
Max Deformation: """)
Z_2 = UnitZ(Factor=series_4)
move_2 = Move(Geometry=pt_2, Motion=Z_2)  # -> Geometry, Transform
rev_2 = ReverseList(List=move_2.Geometry)

# ----
# Adding loads
xy_plane = XYPlane(Origin=Point(0, 0, 0))
create_grid_plane = CreateGridPlane(Plane=xy_plane, GridPlaneID=0, GridElevationInModelUnits=cluster.unit_vector_2, Type="General")
create_grid_surface = CreateGridSurface(GridPlane=create_grid_plane, GridSurfaceID=0, SpanDirection=0, Type="1D, One-way span")
list_item = ListItem(List=cluster.surfaces, Index=0, Wrap=True)  # -> Item, Item1, Item2, Item3
list_item_2 = ListItem(List=create_grid_surface, Index=0, Wrap=True)  # -> Item, Item1, Item2

# ----
# Wind loads
linear_array = LinearArray(Geometry=point, Direction=cluster.unit_vector, Count=no_of_columns_x)  # -> Geometry, Transform
unit_z = UnitZ(Factor=storey_height)
linear_array_2 = LinearArray(Geometry=linear_array.Geometry, Direction=unit_z, Count=expr("x+1", no_of_stories))  # -> Geometry, Transform
split_list = SplitList(List=linear_array_2.Geometry, Index=1)  # -> ListA, ListB
edit_node = EditNode(Node=split_list.ListB, Mode=1)  # -> flatten(Node), NodeNumber, NodePosition, NodeLocalAxis, NodeRestraints, DamperProperty, MassProperty, SpringProperty, NodeName, NodeColour
create_node_load = CreateNodeLoad(LoadCase="4", NodeList=edit_node.Node, Direction="y", Value_kN=loads_3, Type="NodeForce", Unit="kN")

# ----
# Grid area loads
area = Area(Geometry=list_item.Item2)  # -> Area, Centroid
scale = Scale(Geometry=list_item.Item2, Center=area.Centroid, Factor=rect_scale)  # -> Geometry, Transform
vector_xyz = VectorXYZ(XComponent=breadth, YComponent=width, ZComponent=0)  # -> Vector, Length
move_3 = Move(Geometry=scale.Geometry, Motion=vector_xyz.Vector)  # -> Geometry, Transform
value_list_3 = ValueList({"x", "y", "z"}, selected="z")
create_grid_area_load = CreateGridAreaLoad(
    LoadCase="5",
    Brep=move_3.Geometry,
    GridPlaneSurface=list_item_2.Item2,
    Direction=value_list_3,
    Axis=0,
    Projected=False,
    Name="Area Load",
    Value_kN_m²=loads_2,
    ExpansionChanged=False,
    Mode=0,
    Unit="kN/m²")

# ----
# Grid point loads
md_slider = MDSlider(
    SliderMode=0,
    slider_value=Point(0.4402450934, 0.493554092, 0.5),
    x_domain=Domain(0, 1),
    y_domain=Domain(0, 1),
    z_domain=Domain(0, 1))
evaluate_surface = EvaluateSurface(Surface=reparameterize(list_item.Item2), Point=md_slider)  # -> Point, Normal, UDirection, VDirection, Frame
value_list_4 = ValueList({"x", "y", "z"}, selected="z")
point_2 = Point(evaluate_surface.Point)
create_grid_point_load = CreateGridPointLoad(
    LoadCase="7",
    Point=point_2,
    GridPlaneSurface=list_item_2.Item2,
    Direction=value_list_4,
    Axis=0,
    Name="Point Load",
    Value_kN=loads,
    ExpansionChanged=False,
    Mode=0,
    Unit="kN")

# ----
# Grid line loads
number_slider_3 = Slider(6, range=-50..51)
vector_xyz_2 = VectorXYZ(XComponent=Slider(6, range=-50..51), YComponent=number_slider_3, ZComponent=0)  # -> Vector, Length
value_list_5 = ValueList({"x", "y", "z"}, selected="z")

vector_xyz_3 = VectorXYZ(XComponent=Slider(6, range=-50..51), YComponent=Slider(15, range=-50..51), ZComponent=0)  # -> Vector, Length

line = Line(StartPoint=vector_xyz_2.Vector, EndPoint=vector_xyz_3.Vector)
create_grid_line_load = CreateGridLineLoad(
    LoadCase="6",
    PolyLine=line,
    GridPlaneSurface=list_item_2.Item2,
    Direction=value_list_5,
    Axis=0,
    Projected=False,
    Name="Line Load",
    ValueStart_kN_m=loads_at_start,
    ValueEnd_kN_m=loads_at_end,
    ExpansionChanged=False,
    Mode=0,
    Unit="kN/m")

# ----
# Analysis
create_model = CreateModel(
    Properties=flatten([create_steel_section_pool_4, create_steel_section_pool_5, create_steel_section_pool_6]),
    GSAGeometryIn_mm=flatten([create_support, create_2d_member, edit_1d_member.Member1D]),
    Load=flatten([create_grid_area_load, create_grid_line_load, create_grid_point_load, create_gravity_load, create_node_load, faceload_2, faceload]),
    AnalysisTasksCombinations=flatten([σt, create_combination_case, create_steel_design_task]),
    ReMesh=True,
    Tolerance=0.01,
    Unit="m")
data_dam = DataDam(DataDataA=create_model, BufferDelay=10000000, BufferMode=0)
analyse_model = AnalyseModel(ModelS=flatten(data_dam), Analyse=True, ReMesh=False, Tolerance=0.001, Unit="m")  # -> Model, Errors, Warnings, Remarks, Logs
preview_3d_sections = Preview3DSections(ElementMember1D2D=analyse_model.Model)  # -> AnalysisLayerMesh, AnalysisLayerOutlines, DesignLayerMesh, DesignLayerOutlines

list_item_3 = ListItem(List=panel_6, Index=expr("x-1", Slider(2, range=0..10)), Wrap=True)
loaddiagram = LoadDiagrams(
    GSAModel=analyse_model.Model,
    CaseFilterList=list_item_3,
    Annotation=False,
    SignificantDigits=3,
    Colour=ColourSwatch(SwatchColor=RGB(255, 3, 3)),
    Scale=0.4,
    force="kN",
    length="mm",
    model="mm",
    Case_ID="L2",
    Load_Type="All")  # -> DiagramLines, Annotations

# ----
# Steel Design
number_slider_4 = Slider(1, range=0..3)
steel_design = SteelDesign(Model=analyse_model.Model, TaskNumber="1", Iterations=number_slider_4, CheckOnly=Toggle(False))  # -> Model, Errors, Warnings, Remarks, Logs
panel_12 = Panel(steel_design.Warnings)
panel_13 = Panel(steel_design.Logs)
preview_3d_sections_2 = Preview3DSections(ElementMember1D2D=steel_design.Model)  # -> AnalysisLayerMesh, AnalysisLayerOutlines, DesignLayerMesh, DesignLayerOutlines

panel_14 = Panel(steel_design.Remarks)

# ----
# Results before design
select_result = SelectResults(GSAModel=analyse_model.Model, Type="Combination", Case_ID="C1", Permutation="All")

# ----
# Results after design
select_result_2 = SelectResults(GSAModel=steel_design.Model, Type="Combination", Case_ID="C1", Permutation="All")
steel_utilisations = SteelUtilisations(Result=select_result_2, Max_Min="Max Ax")  # -> flatten(Overall), LocalCombined, BucklingCombined, LocalAxial, LocalShearU, LocalShearV, LocalTorsion, LocalMajorMoment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
beam_displacements = BeamDisplacements(Result=select_result_2, IntermediatePoints=3, Max_Min="Max |U|", Unit="mm")  # -> TranslationsX_mm, TranslationsY_mm, flatten(TranslationsZ_mm), TranslationsXYZ_mm, RotationXX_rad, RotationYY_rad, RotationZZ_rad, RotationXYZ_rad
panel_15 = Panel(steel_utilisations.Overall)
panel_16 = Panel(beam_displacements.TranslationsZ_mm)

# ----
# Contour Results
# 2D results
contour_2d_results = Contour2DResults(
    Result=select_result,
    Display=1,
    Mode=1,
    envelope="Absolute",
    flayer=0,
    force="kN/m",
    legend=True,
    legendHeight=110,
    legendScale=1,
    legendWidth=120,
    length="mm",
    model="m",
    moment="kN",
    noDec=0,
    Result_Type="Force",
    Component="Force Ny",
    slider=False,
    stress="MPa",
    val=0,
    valMax=1000,
    valMin=0)  # -> ResultMesh, Colours, LegendValues_kN_m_m
# 1D results
contourelem1d = _1DContourResults(
    Result=select_result,
    ElementFilterList="All",
    IntermediatePoints=10,
    Scale=10,
    Display=2,
    Mode=1,
    energy="MJ",
    envelope="Absolute",
    force="kN",
    legend=True,
    legendHeight=110,
    legendScale=1,
    legendWidth=120,
    length="mm",
    moment="kN·m",
    noDec=0,
    Result_Type="Force",
    Component="Shear Force Fz",
    slider=False,
    stress="MPa",
    val=0,
    valMax=1000,
    valMin=0)  # -> ResultLine, Colours, LegendValues_kN

# ----
# Text
steel_utilisations_2 = SteelUtilisations(Result=select_result, Max_Min="Max Overall")  # -> flatten(Overall), LocalCombined, BucklingCombined, LocalAxial, LocalShearU, LocalShearV, LocalTorsion, LocalMajorMoment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
beam_displacements_2 = BeamDisplacements(Result=select_result, IntermediatePoints=3, Max_Min="Max |U|", Unit="mm")  # -> TranslationsX_mm, TranslationsY_mm, flatten(TranslationsZ_mm), TranslationsXYZ_mm, RotationXX_rad, RotationYY_rad, RotationZZ_rad, RotationXYZ_rad
panel_17 = Panel(beam_displacements_2.TranslationsZ_mm)
panel_18 = Panel(steel_utilisations_2.Overall)

merge_2 = Merge(
    Data2=steel_utilisations_2.Overall,
    Data3=beam_displacements_2.TranslationsZ_mm,
    Data6=steel_utilisations.Overall,
    Data7=beam_displacements.TranslationsZ_mm)  # -> flatten(Result)
concatenate = Concatenate(FragmentA=panel_11, FragmentB=merge_2)
panel_19 = Panel(merge_2)
text_tag = TextTag(Location=rev_2, Text=concatenate, Colour=ColourSwatch(SwatchColor=RGB(0, 0, 0)))

save_gsa_model = SaveGSAModel(GSAModel=steel_design.Model, Save=True, FileAndPath="C:\Temp\Demo sample file.gwb")

getgeo = GetModelGeometry(GSAModel=steel_design.Model, Mode=1, Unit="mm")  # -> NodesIn_mm, _1DElementsIn_mm, _2DElementsIn_mm, _3DElementsIn_mm, _1DMembersIn_mm, _2DMembersIn_mm, _3DMembersIn_mm, Assemblies
getprops = GetModelProperties(GSAModel=steel_design.Model)  # -> Sections, _2DProperties, _3DProperties, SpringProperties
item_6 = ListItem(List=getgeo._1DElementsIn_mm, Index=0, Wrap=True)
item_7 = ListItem(List=getgeo._1DElementsIn_mm, Index="76", Wrap=True)
item_8 = ListItem(List=getgeo._1DElementsIn_mm, Index=Slider(615, range=0..1000), Wrap=True)
panel_20 = Panel(getprops.Sections)
annotate_detailed_2 = AnnotateDetailed(
    ElementMember=[item_8, item_6, item_7],
    Size=1,
    id=False,
    material=False,
    name=False,
    property=True,
    Type="Regular Dot",
    text3d=False)  # -> Annotations, Position, Text
panel_21 = Panel(annotate_detailed_2.Annotations)

# ==== cluster Cluster
factor = ClusterInput()
unit_x = UnitX(Factor=factor)
geometry = ClusterInput()
count = ClusterInput()
factor_2 = ClusterInput()
unit_vector = ClusterOutput(unit_x)
linear_array = LinearArray(Geometry=geometry, Direction=unit_x, Count=count)  # -> Geometry, Transform
factor_3 = ClusterInput()
unit_y = UnitY(Factor=factor_2)
count_2 = ClusterInput()
unit_z = UnitZ(Factor=factor_3)
linear_array_2 = LinearArray(Geometry=linear_array.Geometry, Direction=unit_y, Count=count_2)  # -> Geometry, Transform
count_3 = ClusterInput()
linear_array_3 = LinearArray(Geometry=linear_array_2.Geometry, Direction=unit_z, Count=expr("X+1", count_3))  # -> simplify(Geometry), Transform
A = ClusterInput()
split_tree = SplitTree(Data=linear_array_3.Geometry, Masks=flatten("{?;?}[0]"))  # -> Positive, Negative
A_2 = ClusterInput()
A_3 = ClusterInput()
start = ClusterInput()
step = ClusterInput()
count_4 = ClusterInput()
division = Division(A=A, B=2)
subtraction = Subtraction(A=A_2, B=1)
subtraction_2 = Subtraction(A=A_3, B=1)
A_4 = ClusterInput()
A_5 = ClusterInput()
series = Series(Start=start, Step=step, Count=count_4)
clean_tree = CleanTree(RemoveNulls=True, RemoveInvalid=True, RemoveEmpty=False, Tree=split_tree.Negative)
multiplication = Multiplication(A=A_4, B=subtraction_2)
multiplication_2 = Multiplication(A=A_5, B=subtraction)
unit_y_2 = UnitY(Factor=division)
unit_z_2 = UnitZ(Factor=series)
path_mapper = PathMapper(clean_tree, source="{A;B}(i)", target="{A;i}(B)")
path_mapper_2 = PathMapper(clean_tree, source="{A;B}(i)", target="{i;B}(A)")
clean_tree_2 = CleanTree(RemoveNulls=True, RemoveInvalid=True, RemoveEmpty=False, Tree=split_tree.Positive)
plane_surface = PlaneSurface(Plane=PlaneXY(0, 0, 0), XSize=multiplication_2, YSize=multiplication)
unit_vector_2 = ClusterOutput(unit_z_2)
start_2 = ClusterInput()
step_2 = ClusterInput()
count_5 = ClusterInput()
series_2 = Series(Start=expr("x-1", start_2), Step=step_2, Count=count_5)
move = Move(Geometry=plane_surface, Motion=unit_z_2)  # -> Geometry, Transform
polyline = PolyLine(Vertices=linear_array_3.Geometry, Closed=False)
polyline_2 = PolyLine(Vertices=path_mapper, Closed=False)
polyline_3 = PolyLine(Vertices=path_mapper_2, Closed=False)
move_2 = Move(Geometry=polyline_3, Motion=unit_y_2)  # -> Geometry, Transform
cull_index = CullIndex(List=flatten(move_2.Geometry), Indices=series_2, Wrap=True)  # -> graft(List)

# ---- group: Slabs/planes
boundary_surfaces = BoundarySurfaces(Edges=move.Geometry, UseTasks=True)

# ---- group: Primary Beams
explode = Explode(Curve=polyline_2, Recursive=True)  # -> simplify(flatten(Segments)), Vertices
explode_2 = Explode(Curve=polyline_3, Recursive=True)  # -> simplify(flatten(Segments)), Vertices

# ---- group: Columns
explode_3 = Explode(Curve=polyline, Recursive=True)  # -> simplify(flatten(Segments)), Vertices

# ---- group: Secondary beams
explode_4 = Explode(Curve=cull_index, Recursive=True)  # -> simplify(flatten(Segments)), Vertices

# ---- group: Supports
point = Point(flatten(clean_tree_2))

# ----
point_2 = ClusterOutput(point)
surfaces = ClusterOutput(boundary_surfaces)
segments = ClusterOutput(explode.Segments)
segments_2 = ClusterOutput(explode_2.Segments)
segments_3 = ClusterOutput(explode_3.Segments)
segments_4 = ClusterOutput(explode_4.Segments)
