# Grasshopper definition Connection modelling.gh (Grasshopper 1.0.7)
# Copyright: Arup
# plug-ins: GSA

radius = Slider(1.7, range=0..2)

# ----
# INPUT
# Download the Connection modelling
# (Seed file) and enter its path here
# Select node ID within the range of nodes
node_id = Slider(115, range=1..580)
open = OpenModel(FilenameAndPath="C:\Temp\Connection modelling (Seed file).gwb")

getgeo = GetModelGeometry(GSAModel=open, Mode=1, Unit="m")  # -> NodesIn_m, _1DElementsIn_m, _2DElementsIn_m, _3DElementsIn_m, _1DMembersIn_m, _2DMembersIn_m, _3DMembersIn_m, Assemblies
getgeo_2 = GetModelGeometry(GSAModel=open, NodeFilterList=node_id, Mode=1, Unit="m")  # -> NodesIn_m, _1DElementsIn_m, _2DElementsIn_m, _3DElementsIn_m, _1DMembersIn_m, _2DMembersIn_m, _3DMembersIn_m, Assemblies
integer = Integer(getgeo.NodesIn_m)

node_range = Panel(integer)

no = Node(getgeo_2.NodesIn_m)
mem1dedit = Edit1DMember(Member1D=getgeo._1DMembersIn_m, Preview3dSection=False)  # -> Member1D, Member1dNumber, Curve, Property, MemberGroup, MemberType, _1DElementType, Offset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
nodeedit = EditNode(Node=no, Mode=1)  # -> Node, NodeNumber, NodePosition, NodeLocalAxis, NodeRestraints, DamperProperty, MassProperty, SpringProperty, NodeName, NodeColour
split = TextSplit(Text=mem1dedit.Topology, Separators=" ")  # -> simplify(Result)
equals = Equality(FirstNumber=split, SecondNumber=nodeedit.NodeNumber)  # -> simplify(Equality), Inequality
ma = MassAddition(Input=equals.Equality)  # -> flatten(Result), PartialResults
equals_2 = Equality(FirstNumber=ma.Result, SecondNumber="1")  # -> Equality, Inequality
cull = CullPattern(List=getgeo._1DMembersIn_m, CullPattern=equals_2.Equality)
mem1dedit_2 = Edit1DMember(Member1D=cull, MeshSizeInModelUnits=radius, Preview3dSection=False)  # -> Member1D, Member1dNumber, Curve, Property, MemberGroup, MemberType, _1DElementType, Offset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
elemfrommem = CreateElementsFromMembers(_1DMembers_mm=mem1dedit_2.Member1D, Tolerance=0.001, Unit="m")  # -> Nodes, _1DElements, _2DElements, _3DElements, GSAModel
pt = Point(no)
sph = Sphere(Base=pt, Radius=expr("x+1", radius))
line = Line(elemfrommem._1DElements)
shapein = ShapeInBrep(Brep=sph, Shape=line)
equals_3 = Equality(FirstNumber=shapein, SecondNumber="0")  # -> Equality, Inequality
cull_2 = CullPattern(List=elemfrommem._1DElements, CullPattern=equals_3.Equality)
b2s = ExpandBeamToShell(ElementMember1D=cull_2, LengthUnit="Meter", Tolerance=2e-05)  # -> flatten(Member2D)
mem2dedit = Edit2DMember(Member2D=b2s, MeshSizeInModelUnits=Slider(0.1, range=0..1), Preview3dSection=False)  # -> Member2D, MemberNumber, Brep, InclPoints, InclCurves, _2DProperty, MemberGroup, MemberType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
model = CreateModel(GSAGeometryIn_m=flatten(mem2dedit.Member2D), ReMesh=True, Tolerance=0.001, Unit="m")

save = SaveGSAModel(GSAModel=model, Save=True, FileAndPath="C:\Temp\Connection modelling.gwb")
