# Grasshopper definition Flat slab meshing.gh (Grasshopper 1.0.7)
# plug-ins: GSA

# ----
# Note : Drag and drop the 'Flat slab meshing.3dm' file in Rhino page to open it.
# The points, curves and surfaces will be extracted.
# Inputs
slab_mesh_size = Slider(1.5, range=0..10)
drop_panel_mesh_size = Slider(1, range=0..10)

material = CreateCustomMaterial(
    ElasticModulus_MPa="30000",
    PoissonsRatio="0.3",
    Density_kg_m³="2400",
    Material_Type="Concrete",
    Stress_Unit="MPa",
    Density_Unit="kg/m³",
    Temperature_Unit="K")
profile = CreateProfile(
    Depth_mm=Slider(700, range=0..1000),
    Width_mm=Slider(700, range=0..1000),
    catalogueIndex=-1,
    inclSS=False,
    lengthUnit="Millimeter",
    mode="Other",
    Profile_type="Rectangle",
    Measure="mm",
    typeIndex=-1)
prop2d = Create2DProperty(Thickness_mm=Slider(150, range=0..1000), Material=material, Type="Shell", Unit="mm")
prop2d_2 = Create2DProperty(Thickness_mm=Slider(300, range=0..1000), Material=material, Type="Shell", Unit="mm")
section = CreateSection(Profile=profile, Material=material, Basic_Offset="Centroid")
dup = DuplicateData(Data=prop2d_2, Number="6", Order=True)
dup_2 = DuplicateData(Data=drop_panel_mesh_size, Number="6", Order=True)
srf = Surface([<surface referenced from the Rhino model> x6])
srf_2 = Surface(<surface referenced from the Rhino model>)
merge = Merge(Data1=prop2d, Data2=dup)  # -> flatten(Result)
merge_2 = Merge(Data1=slab_mesh_size, Data2=dup_2)  # -> flatten(Result)
merge_3 = Merge(Data1=srf_2, Data2=srf)
crv = Curve([<curve referenced from the Rhino model> x6])
pt = Point([<point referenced from the Rhino model> x6])
mem2d = Create2DMember(
    Brep=merge_3,
    Property2D=merge,
    MeshSizeInModelUnits=merge_2,
    InternalOffset=True,
    Preview3dSection=False,
    Mesh_mode="Quad dominant")
mem1d = Create1DMember(
    Curve=crv,
    Property=section,
    Preview3dSection=False,
    x1=False,
    x2=False,
    xx1=False,
    xx2=False,
    y1=False,
    y2=False,
    yy1=False,
    yy2=False,
    z1=False,
    z2=False,
    zz1=False,
    zz2=False)
support = CreateSupport(Point=pt, Plane=PlaneXY(0, 0, 0), x=True, xx=True, y=True, yy=True, z=True, zz=True)
gravityload = CreateGravityLoad(LoadCase=null, GravityFactor=Vector(0, 0, -1))
analyse = AnalyseModel(
    GSAGeometryIn_m=flatten([support, mem1d, mem2d]),
    Loads=gravityload,
    Analyse=True,
    ReMesh=True,
    Tolerance=0.01,
    Geometry_Unit="Meter")  # -> Model, Errors, Warnings, Remarks, Log

save = SaveGSAModel(GSAModel=analyse.Model, Save=True, FileAndPath="C:\Temp\Flat slab.gwb")

selres = SelectResults(GSAModel=analyse.Model, Type="AnalysisCase", Case_ID="A1")
contour2d = Contour2DResults(
    Result=selres,
    Display=3,
    Mode=0,
    envelope="Absolute",
    flayer=0,
    force="N/m",
    legend=True,
    legendScale=1,
    length="mm",
    model="mm",
    moment="N",
    noDec=0,
    Result_Type="Displacement",
    Component="Resolved |U|",
    slider=True,
    stress="Pa",
    val=0,
    valMax=1000,
    valMin=0)  # -> M, Colours, Values_mm
