# Grasshopper definition Truss.gh (Grasshopper 1.0.7)
# plug-ins: GSA

# ---- group: Chord sections
material = CreateCustomMaterial(
    ElasticModulus_MPa="210000",
    PoissonsRatio=".3",
    Density_kg_m³="7850",
    Material_Type="Steel",
    Stress_Unit="MPa",
    Density_Unit="kg/m³",
    Temperature_Unit="°C")
profile = CreateProfile(
    catalogueIndex=3,
    inclSS=False,
    lengthUnit="Centimeter",
    mode="Catalogue",
    Profile_type="Catalogue",
    Catalogue="Europrofile",
    Type="EP HE beams",
    Profile="HE HE450.B",
    typeIndex=27)
section = CreateSection(Profile=profile, Material=material, Basic_Offset="Centroid")

# ----
# Inputs
truss_length = Slider(15, range=5..20)
truss_height = Slider(1.5, range=1..5)
number_of_segments = Slider(7, range=5..15)
truss_spacing = Slider(3, range=0..10)

pt = ConstructPoint(XCoordinate=0, YCoordinate=0, ZCoordinate=0)
pt_2 = ConstructPoint(XCoordinate=0, YCoordinate=truss_length, ZCoordinate=0)
division = Division(A=truss_length, B=truss_height)
span_to_depth_ratio = Panel(division)
ln = Line(StartPoint=pt, EndPoint=pt_2)

# ---- group: Vertical and diagonal sections
material_2 = CreateCustomMaterial(
    ElasticModulus_MPa="210000",
    PoissonsRatio=".3",
    Density_kg_m³="7850",
    Material_Type="Steel",
    Stress_Unit="MPa",
    Density_Unit="kg/m³",
    Temperature_Unit="°C")
profile_2 = CreateProfile(
    catalogueIndex=3,
    inclSS=False,
    lengthUnit="Centimeter",
    mode="Catalogue",
    Profile_type="Catalogue",
    Catalogue="Europrofile",
    Type="EP HE beams",
    Profile="HE HE100.A",
    typeIndex=27)
section_2 = CreateSection(Profile=profile_2, Material=material_2, Basic_Offset="Centroid")

# ---- group: Bottom chords
mem1d = Create1DMember(
    Curve=ln,
    Property=section,
    Preview3dSection=False,
    x1=False,
    x2=False,
    xx1=False,
    xx2=False,
    y1=False,
    y2=False,
    yy1=False,
    yy2=False,
    z1=False,
    z2=False,
    zz1=False,
    zz2=False)

# ----
Z = UnitZ(Factor=truss_height)
support = CreateSupport(Point=pt, Plane=PlaneXY(0, 0, 0), x=True, xx=True, y=True, yy=True, z=True, zz=True)
move = Move(Geometry=support, Motion=Z)  # -> Geometry, Transform

# ---- group: Top chords
move_2 = Move(Geometry=mem1d, Motion=Z)  # -> Geometry, Transform

# ----
divide = DivideCurve(Curve=move_2.Geometry, Count=number_of_segments, Kinks=False)  # -> Points, Tangents, Parameters
rev = Reverse(Vector=Z)
no = Node([move.Geometry, support])
line = LineSDL(Start=divide.Points, Direction=rev, Length=rev)
split = SplitList(List=divide.Points, Index=number_of_segments)  # -> ListA, ListB
end = EndPoints(Curve=line)  # -> Start, End
X = UnitX(Factor=truss_spacing)
no_2 = Node(no)
move_3 = Move(Geometry=no_2, Motion=X)  # -> Geometry, Transform
shift = ShiftList(List=end.End, Shift=1, Wrap=False)
no_3 = Node([no_2, move_3.Geometry])
ln_2 = Line(StartPoint=split.ListA, EndPoint=shift)

# ---- group: Vertical and Diagonal bracings
mem1d_2 = Create1DMember(
    Curve=[ln_2, line],
    Property=section_2,
    Preview3dSection=False,
    x1=False,
    x2=False,
    xx1=False,
    xx2=False,
    y1=False,
    y2=False,
    yy1=False,
    yy2=False,
    z1=False,
    z2=False,
    zz1=False,
    zz2=False)  # -> flatten(Member1D)

# ----
line_2 = LineSDL(Start=end.Start, Direction=X, Length=X)
mem1dedit = Edit1DMember(Member1D=mem1d_2, _1DElementType="1", Preview3dSection=False)  # -> Member1D, Member1dNumber, Curve, Property, MemberGroup, MemberType, _1DElementType, Offset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
m1d = _1DMember([move_2.Geometry, mem1d, mem1dedit.Member1D])

# ---- group: Plan bracings
mem1d_3 = Create1DMember(
    Curve=line_2,
    Property=section_2,
    Preview3dSection=False,
    x1=False,
    x2=False,
    xx1=False,
    xx2=False,
    y1=False,
    y2=False,
    yy1=False,
    yy2=False,
    z1=False,
    z2=False,
    zz1=False,
    zz2=False)

# ----
move_4 = Move(Geometry=m1d, Motion=X)  # -> Geometry, Transform
mem1dedit_2 = Edit1DMember(Member1D=mem1d_3, _1DElementType="1", Preview3dSection=False)  # -> Member1D, Member1dNumber, Curve, Property, MemberGroup, MemberType, _1DElementType, Offset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
m1d_2 = _1DMember([move_4.Geometry, m1d])
gravityload = CreateGravityLoad(LoadCase=null, GravityFactor=Vector(0, 0, -1))
analyse = AnalyseModel(
    GSAGeometryIn_m=flatten([mem1dedit_2.Member1D, m1d_2, no_3]),
    Loads=gravityload,
    Analyse=True,
    ReMesh=True,
    Tolerance=0.01,
    Geometry_Unit="Meter")  # -> Model, Errors, Warnings, Remarks, Log
selres = SelectResult(GSAModel=analyse.Model, Type="AnalysisCase", Case_ID="A1")
res = Result(selres)
contour1d = Contour1DResults(
    Result=selres,
    IntermediatePoints=10,
    Scale=10,
    Display=0,
    Mode=1,
    energy="J",
    envelope="Absolute",
    force="N",
    legend=True,
    legendScale=1,
    length="mm",
    moment="N·m",
    noDec=0,
    Result_Type="Force",
    Component="Axial Force Fx",
    slider=False,
    stress="MPa",
    val=0,
    valMax=1000,
    valMin=0)  # -> L, Colours, LegendValues_N
beamdisp = BeamDisplacements(Result=res, IntermediatePoints=3, Max_Min="All", Unit="mm")  # -> TranslationsX_mm, TranslationsY_mm, TranslationsZ_mm, TranslationsXYZ_mm, RotationXX_rad, RotationYY_rad, RotationZZ_rad, RotationXYZ_rad
sort = SortList(Keys=flatten(beamdisp.TranslationsXYZ_mm))  # -> Keys, ValuesA
item = ListItem(List=reverse(sort.Keys), Index=0, Wrap=True)

# ---- group: MaxU
num = Number(item)

# ----
maxdeflection = Panel(num)
